# Grasshopper definition AR1B024_16_Architectural_Code_Cerneus_Maniatis_Bentvelsen_Grasshopper.gh (Grasshopper 1.0.7)
# plug-ins: Speckle 2, Bifocals, LunchBox

receive = Receive(
    Stream="https://speckle.xyz/streams/032265984e",
    AutoReceive=False,
    CurrentComponentState="up_to_date",
    ExpandOutput=True,
    LastInfoMessage="Friso @ 05/23/2023 19:17:42: Sent objects from QGIS (id:66cd7b9445)",
    ReceiveOnOpen=False,
    ReceivedCommitId="66cd7b9445",
    StreamWrapper="https://speckle.xyz/streams/032265984e",
    selectedKitName="Objects")  # -> Info, Layers, Units
deconstruct_speckle_object = DeconstructSpeckleObject(SpeckleObject=receive.Layers, selectedKitName="Objects")  # -> Features, Name
explode_tree = ExplodeTree(Data=deconstruct_speckle_object.Features)  # -> Branch0, Branch1, Branch2, Branch3, Branch4
param_viewer = ParamViewer(deconstruct_speckle_object.Features)
panel = Panel(deconstruct_speckle_object.Name)

deconstruct_speckle_object_2 = DeconstructSpeckleObject(SpeckleObject=explode_tree.Branch1, selectedKitName="Objects")  # -> flatten(Geometry), flatten(H_dak_70p)
panel_2 = Panel(deconstruct_speckle_object_2.Geometry)
panel_3 = Panel(deconstruct_speckle_object_2.Geometry)
find_similar_member = FindSimilarMember(Data="None", Set=panel_2)  # -> Hit, Index
create_set = CreateSet(List=panel_3)  # -> Set, Map
cull_index = CullIndex(List=deconstruct_speckle_object_2.Geometry, Indices=find_similar_member.Index, Wrap=True)  # -> graft(List)
cull_index_2 = CullIndex(List=deconstruct_speckle_object_2.H_dak_70p, Indices=find_similar_member.Index, Wrap=True)  # -> graft(List)
panel_4 = Panel(create_set.Set)
deconstruct_speckle_object_3 = DeconstructSpeckleObject(SpeckleObject=cull_index, selectedKitName="Objects")
curve = Curve(flatten(deconstruct_speckle_object_3))

# ----
# WIND
# VIEW
max_wind_speed = Slider(600, range=0..10000)
max_wind_speed_2 = Slider(1000, range=0..10000)
max_wind_speed_3 = Slider(2000, range=0..10000)
min_distance = Slider(30000, range=0..100000)
min_distance_2 = Slider(60000, range=0..100000)
min_distance_3 = Slider(90000, range=0..100000)
fill_in_1_2_3 = Panel("1")
fill_in_1_2_3_2 = Panel("2")
subtraction = Subtraction(A=fill_in_1_2_3_2, B=1)
subtraction_2 = Subtraction(A=fill_in_1_2_3, B=1)
stream_filter = StreamFilter(Gate=subtraction, Stream0=max_wind_speed, Stream1=max_wind_speed_2, Stream2=max_wind_speed_3)
stream_filter_2 = StreamFilter(Gate=subtraction_2, Stream0=min_distance, Stream1=min_distance_2, Stream2=min_distance_3)

# ---- group: Min wall length
# ROOF PILLARS LOCATION
number_slider = Slider(2000, range=0..10000)

# ---- group: Eliptical
false_rectangle = BooleanToggle(False)

# ----
# CONVEX_CONCAVE
# ROOF_ELLIPSE
boolean_toggle = BooleanToggle(False)

# ---- group: Convex Concave toggle
false_concave = BooleanToggle(False)

# ----
# Positioning Columns
number_slider_2 = Slider(0.655, range=0..1)

# ---- group: 03. Change name
panel_5 = Panel("Rectangle_")
panel_6 = Panel("Zuidpoort_")
panel_7 = Panel("Concave_")
panel_8 = Panel("1_")
panel_9 = Panel("1")
panel_10 = Panel(".stl")

# ---- group: 01. Connect false
boolean_toggle_2 = BooleanToggle(False)

# ---- group: 04. Connect true
boolean_toggle_3 = BooleanToggle(True)

# ---- group: 00. Set directory
file_path = FilePath("D:\3.0 Technische Universiteit Delft\MSc Building Technology\Leerjaar 1\Kwartaal 01\AR1B024 Computational Design - 5 ECTS\3.0 Design\3.2 Python\")

# ---- group: Copied values
total_population_each_voronoi = Panel("""0
0
0
0
0
0
342
570
1082
523
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""")

# ----
number_slider_3 = Slider(7, range=0..24)
number_slider_4 = Slider(2, range=1..4)
addition = Addition(A=number_slider_3, B=number_slider_4)
subtraction_3 = Subtraction(A=Slider(17, range=0..24), B=number_slider_3)
subtraction_4 = Subtraction(A=addition, B=1)
division = Division(A=subtraction_3, B=number_slider_4)
series = Series(Start=subtraction_4, Step=number_slider_4, Count=division)
series_2 = Series(Start=number_slider_3, Step=number_slider_4, Count=division)
panel_11 = Panel(series)
panel_12 = Panel(series_2)
analysisperiod = LBAnalysisPeriod(
    start_month=Slider(1, range=1..12),
    start_day=Slider(1, range=1..31),
    start_hour=panel_12,
    end_month=Slider(12, range=1..12),
    end_day=Slider(31, range=1..31),
    end_hour=panel_11,
    timestep=Slider(1, range=1..6))  # -> period, hoys, dates; plug-in component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

height_bounding_volume_bus_stop = Panel("2400")

# ---- group: Offset roof
# Important datadams!
number_slider_5 = Slider(300, range=0..300)

# ---- group: Gene Pool E-W
gene_pool = GenePool(Decimals=2, Maximum=1, Minimum=-1, Value=[0.26, 0.55, 0.55, 0.65, 0.26])

# ---- group: Height frame
number_slider_6 = Slider(120, range=0..200)

# ---- group: Width main frame
number_slider_7 = Slider(40, range=0..100)

# ---- group: Height roof
number_slider_8 = Slider(2600, range=0..10000)

# ---- group: Approx distance between supports
number_slider_9 = Slider(1000, range=500..2000)

# ---- group: Width secondairy pipes
number_slider_10 = Slider(24, range=0..100)

# ---- group: Width supports panels
number_slider_11 = Slider(100, range=0..100)

# ---- group: Height supports panels
number_slider_12 = Slider(12, range=0..100)

# ---- group: Offset panels
number_slider_13 = Slider(10, range=0..20)

# ---- group: Height panels
number_slider_14 = Slider(18, range=0..100)

# ---- group: Offset frame
number_slider_15 = Slider(0, range=0..300)

# ---- group: Truss height
number_slider_16 = Slider(500, range=0..1000)

# ----
diameter = Slider(40, range=0..100)
thickness = Slider(4, range=0..100)

number_slider_17 = Slider(0.6, range=0.5..1)
number_slider_18 = Slider(0.2, range=0..0.45)
number_slider_19 = Slider(0.5, range=0.5..1)
number_slider_20 = Slider(0.8, range=0.5..1)
number_slider_21 = Slider(0, range=0..0.45)
number_slider_22 = Slider(0.26, range=0..0.45)
ghpython_script = GhPythonScript(s1=number_slider_19, s2=number_slider_20, s3=number_slider_17)  # -> md_out
# ---------- ghpython_script: Python ----------
"""Provides a scripting component.
    Inputs:
        s1: The first number slider value
        s2: The second number slider value
        s3: The third number slider value
    Output:
        md_out: The output replicating an MD Slider, formatted as a string"""

__author__ = "Your Name"
__version__ = "2024.01.04"

# Create the output string in the format "{value1, value2, value3}"
md_out = "{{{0}, {1}, {2}}}".format(s1, s2, s3)
# ---------- end ghpython_script ----------
ghpython_script_2 = GhPythonScript(s1=number_slider_21, s2=number_slider_18, s3=number_slider_22)  # -> md_out; same code as ghpython_script
panel_13 = Panel(ghpython_script_2)
panel_14 = Panel(ghpython_script)
galapagos = Galapagos(
    fitness=average_4,
    gene=[number_slider_19, number_slider_20, number_slider_17, number_slider_21, number_slider_18, number_slider_22])

# ---- group: MD Slider
md_slider = MDSlider(
    SliderMode=0,
    slider_value=Point(0.4640919755, 0.6772442329, 0.5),
    x_domain=Domain(0, 1),
    y_domain=Domain(0, 1),
    z_domain=Domain(0, 1))

# ---- group: Default to false, only turn to true for previsualisations
boolean_toggle_4 = BooleanToggle(False)

# ---- group: Min length edge
number_slider_23 = Slider(800, range=0..1000)

# ----
deconstruct_speckle_object_4 = DeconstructSpeckleObject(SpeckleObject=explode_tree.Branch0, selectedKitName="Objects")  # -> AantalInwoners0Tot15Jaar, AantalInwoners15Tot25Jaar, AantalInwoners25Tot45Jaar, AantalInwoners45Tot65Jaar, flatten(Geometry)
panel_15 = Panel([deconstruct_speckle_object_4.AantalInwoners0Tot15Jaar, deconstruct_speckle_object_4.AantalInwoners15Tot25Jaar, deconstruct_speckle_object_4.AantalInwoners25Tot45Jaar, deconstruct_speckle_object_4.AantalInwoners45Tot65Jaar])
surface = Surface(deconstruct_speckle_object_3)
deconstruct_speckle_object_5 = DeconstructSpeckleObject(SpeckleObject=deconstruct_speckle_object_4.Geometry, selectedKitName="Objects")
deconstruct_speckle_object_6 = DeconstructSpeckleObject(SpeckleObject=deconstruct_speckle_object_4.Geometry, selectedKitName="Objects")
area = Area(Geometry=surface)  # -> Area, flatten(Centroid)
expression = Expression(dataRow=panel_15, Expression="if(dataRow=\"-99997\",0,dataRow)")
area_2 = Area(Geometry=deconstruct_speckle_object_6)  # -> Area, flatten(Centroid)
mass_addition = MassAddition(Input=expression)  # -> Result, PartialResults
surface_2 = Surface(deconstruct_speckle_object_3)
area_3 = Area(Geometry=surface_2)  # -> Area, flatten(Centroid)

# ---- group: 03. Identifying bus stop
deconstruct_speckle_object_7 = DeconstructSpeckleObject(SpeckleObject=explode_tree.Branch2, selectedKitName="Objects")  # -> flatten(Geometry), Name
panel_16 = Panel(deconstruct_speckle_object_7.Name)

# ----
list_item = ListItem(List=flatten(deconstruct_speckle_object_7.Name), Index="8", Wrap=True)
list_item_2 = ListItem(List=flatten(deconstruct_speckle_object_7.Name), Index="152", Wrap=True)
list_item_3 = ListItem(List=flatten(deconstruct_speckle_object_7.Name), Index="59", Wrap=True)
list_item_4 = ListItem(List=flatten(deconstruct_speckle_object_7.Name), Index="25", Wrap=True)
list_item_5 = ListItem(List=flatten(deconstruct_speckle_object_7.Name), Index="45", Wrap=True)
panel_17 = Panel(list_item_2)
panel_18 = Panel(list_item)
panel_19 = Panel(list_item_3)
panel_20 = Panel(list_item_4)
panel_21 = Panel(list_item_5)

# ---- group: These influence the location
list_item_6 = ListItem(List=flatten(deconstruct_speckle_object_7.Geometry), Index="8", Wrap=True)
list_item_7 = ListItem(List=flatten(deconstruct_speckle_object_7.Geometry), Index="152", Wrap=True)
list_item_8 = ListItem(List=flatten(deconstruct_speckle_object_7.Geometry), Index="59", Wrap=True)
list_item_9 = ListItem(List=flatten(deconstruct_speckle_object_7.Geometry), Index="25", Wrap=True)
list_item_10 = ListItem(List=flatten(deconstruct_speckle_object_7.Geometry), Index="45", Wrap=True)
panel_22 = Panel(list_item_6)
panel_23 = Panel(list_item_8)
panel_24 = Panel(list_item_10)
panel_25 = Panel(list_item_7)
panel_26 = Panel(list_item_9)

# ---- group: 03. Identifying bus stop (continued)
point = Point(list_item_6)
closest_point = ClosestPoint(Point=point, Cloud=flatten(deconstruct_speckle_object_7.Geometry))  # -> ClosestPoint, CPIndex, Distance
list_item_11 = ListItem(List=flatten(deconstruct_speckle_object_7.Name), Index=closest_point.CPIndex, Wrap=True)
division_2 = Division(A=closest_point.Distance, B=1000)
panel_27 = Panel(list_item_11)
panel_28 = Panel(division_2)

# ----
# ONLY FOR ZUIDPOORT
bus_stop_location = Panel(closest_point.CPIndex)
addition_2 = Addition(A=bus_stop_location, B="1")
panel_29 = Panel(addition_2)

xy_plane = XYPlane(Origin=Point(0, 0, 0))
point_2 = Point(deconstruct_speckle_object_7.Geometry)
voronoi = Voronoi(Points=flatten(point_2), Plane=xy_plane, BruteForceOverride=False)
list_item_12 = ListItem(List=voronoi, IndexCounter=[bus_stop_location, addition_2], Wrap=True)
list_item_13 = ListItem(List=voronoi, Index=bus_stop_location, Wrap=True)

offset_curve = OffsetCurve(Curve=list_item_13, Distance="50", Corners=1)
point_in_curve = PointInCurve(Point=area.Centroid, Curve=graft(list_item_12))  # -> Relationship, Point
point_in_curve_2 = PointInCurve(Point=area_2.Centroid, Curve=graft(offset_curve))  # -> Relationship, Point
equality = Equality(FirstNumber=point_in_curve.Relationship, SecondNumber=2)  # -> Equality, Inequality
equality_2 = Equality(FirstNumber=point_in_curve_2.Relationship, SecondNumber=2)  # -> Equality, Inequality
dispatch = Dispatch(List=flatten(surface), DispatchPattern=equality.Equality)  # -> ListA, ListB
dispatch_2 = Dispatch(List=flatten(deconstruct_speckle_object_5), DispatchPattern=equality_2.Equality)  # -> ListA, ListB
dispatch_3 = Dispatch(List=flatten(mass_addition.Result), DispatchPattern=equality_2.Equality)  # -> flatten(ListA), ListB
area_4 = Area(Geometry=dispatch.ListA)  # -> Area, flatten(Centroid)
curve_2 = Curve(dispatch_2.ListA)
point_in_curve_3 = PointInCurve(Point=area_4.Centroid, Curve=graft(curve_2))  # -> Relationship, Point
point_in_curve_4 = PointInCurve(Point=area_3.Centroid, Curve=graft(curve_2))  # -> Relationship, Point
equality_3 = Equality(FirstNumber=point_in_curve_3.Relationship, SecondNumber=2)  # -> Equality, Inequality
equality_4 = Equality(FirstNumber=point_in_curve_4.Relationship, SecondNumber=2)  # -> Equality, Inequality
dispatch_4 = Dispatch(List=flatten(dispatch.ListA), DispatchPattern=equality_3.Equality)  # -> ListA, ListB
dispatch_5 = Dispatch(List=flatten(surface_2), DispatchPattern=equality_4.Equality)  # -> ListA, ListB
surface_3 = Surface(dispatch_5.ListA)
surface_4 = Surface(dispatch_4.ListA)
area_5 = Area(Geometry=surface_4)  # -> Area, Centroid
area_6 = Area(Geometry=surface_3)  # -> Area, Centroid
mass_addition_2 = MassAddition(Input=area_5.Area)  # -> Result, PartialResults
mass_addition_3 = MassAddition(Input=area_6.Area)  # -> Result, PartialResults
replace_nulls = ReplaceNulls(Items=mass_addition_2.Result, Replacements=0)  # -> simplify(flatten(Items)), Count
replace_nulls_2 = ReplaceNulls(Items=mass_addition_3.Result, Replacements=1)  # -> simplify(flatten(Items)), Count
area_selected_voronoi = Panel(replace_nulls.Items)
area_selected_boxes = Panel(replace_nulls_2.Items)
total_population_selected_boxes = Panel(dispatch_3.ListA)
division_3 = Division(A=area_selected_voronoi, B=area_selected_boxes)
multiplication = Multiplication(A=flatten(total_population_selected_boxes), B=flatten(division_3))
round = Round(Number=multiplication)  # -> Nearest, Floor, Ceiling
population_selected_voronoi = Panel(round.Nearest)
mass_addition_4 = MassAddition(Input=population_selected_voronoi)  # -> Result, PartialResults
total_population_selected_voronoi = Panel(mass_addition_4.Result)
data_recorder = DataRecorder(total_population_selected_voronoi, DataLimit=-10, RecordData=False)
cull_index_3 = CullIndex(List=data_recorder, Indices=0, Wrap=True)
total_population_each_voronoi_2 = Panel(cull_index_3)

area_7 = Area(Geometry=curve)  # -> Area, Centroid
curve_3 = Curve(graft(list_item_12))
point_in_curve_5 = PointInCurve(Point=area_7.Centroid, Curve=curve_3)  # -> Relationship, Point
equality_5 = Equality(FirstNumber=point_in_curve_5.Relationship, SecondNumber="2")  # -> Equality, Inequality
boundary_surfaces = BoundarySurfaces(Edges=curve_3)
cull_pattern = CullPattern(List=curve, CullPattern=equality_5.Equality)
cull_pattern_2 = CullPattern(List=flatten(cull_index_2), CullPattern=equality_5.Equality)
surface_5 = Surface(cull_pattern)
unit_z = UnitZ(Factor=expr("x*1000", cull_pattern_2))
custom_preview = CustomPreview(Geometry=boundary_surfaces, Material=ColourSwatch(SwatchColor=RGB(230, 230, 230)))
extrude = Extrude(Base=surface_5, Direction=unit_z)
brep = Brep(extrude)
custom_preview_2 = CustomPreview(Geometry=extrude, Material=ColourSwatch(SwatchColor=RGB(232, 232, 232)))

# ---- group: 05. Creating base plane bus stop
deconstruct_speckle_object_8 = DeconstructSpeckleObject(SpeckleObject=explode_tree.Branch3, selectedKitName="Objects")
explode = Explode(Curve=flatten(deconstruct_speckle_object_8), Recursive=True)  # -> Segments, Vertices
curve_closest_point = CurveClosestPoint(Point=closest_point.ClosestPoint, Curve=explode.Segments)  # -> Point, Parameter, Distance
sort_list = SortList(
    Keys=flatten(curve_closest_point.Distance),
    ValuesValuesA=flatten(explode.Segments),
    ValuesA=flatten(curve_closest_point.Parameter))  # -> Keys, ValuesValuesA, ValuesA
list_item_14 = ListItem(List=sort_list.ValuesValuesA, Index=0, Wrap=True)
list_item_15 = ListItem(List=sort_list.ValuesA, Index=0, Wrap=True)
curve_closest_point_2 = CurveClosestPoint(Point=closest_point.ClosestPoint, Curve=list_item_14)  # -> Point, Parameter, Distance
horizontal_frame = HorizontalFrame(Curve=list_item_14, Parameter=list_item_15)

# ----
smaller_than = SmallerThan(FirstNumber=total_population_each_voronoi, SecondNumber=Slider(100, range=0..200))  # -> SmallerThan, OrEqualTo
dispatch_6 = Dispatch(List=total_population_each_voronoi, DispatchPattern=smaller_than.SmallerThan)  # -> ListA, ListB
minimum_width = Slider(3000, range=0..10000)
maximum_width = Slider(9000, range=0..10000)
population_without_0_values = Panel(dispatch_6.ListB)
construct_domain = ConstructDomain(DomainStart=minimum_width, DomainEnd=maximum_width)
bounds = Bounds(Numbers=population_without_0_values)
number = Number(population_without_0_values)
average = Average(Input=number)
remap_numbers = RemapNumbers(Value=total_population_selected_voronoi, Source=bounds, Target=construct_domain)  # -> Mapped, Clipped
population_range = Panel(bounds)
round_2 = Round(Number=average)  # -> Nearest, Floor, Ceiling
round_3 = Round(Number=remap_numbers.Mapped)  # -> Nearest, Floor, Ceiling
population_mean_value = Panel(round_2.Nearest)
width_bounding_volume_bus_stop = Panel(round_3.Nearest)
depth_bounding_volume_bus_stop = Panel("1800")
height_bounding_volume_bus_stop_2 = Panel("2400")
construct_domain_2 = ConstructDomain(DomainStart=expr("-x/2", width_bounding_volume_bus_stop), DomainEnd=expr("x/2", width_bounding_volume_bus_stop))
construct_domain_3 = ConstructDomain(DomainStart=expr("(-x/2)", depth_bounding_volume_bus_stop), DomainEnd=expr("(x/2)", depth_bounding_volume_bus_stop))
rectangle = Rectangle(Plane=horizontal_frame, XSize=construct_domain_2, YSize=construct_domain_3, Radius=0)  # -> Rectangle, Length
number_2 = Number(expr("x/1000", height_bounding_volume_bus_stop_2))
box_rectangle = BoxRectangle(Rectangle=rectangle.Rectangle, Height=number_2)
deconstruct_brep = DeconstructBrep(Brep=box_rectangle)  # -> Faces, Edges, Vertices
list_item_16 = ListItem(List=deconstruct_brep.Vertices, Index=0, Wrap=True)  # -> Item, Item1, Item2, Item3
point_3 = Point(list_item_16.Item)
point_4 = Point(list_item_16.Item3)
line = Line(StartPoint=point_3, EndPoint=point_4)
amplitude = Amplitude(Vector=line, Amplitude=expr("-x", Slider(3000, range=0..5000)))
move = Move(Geometry=box_rectangle, Motion=amplitude)  # -> Geometry, Transform
brep_2 = Brep(move.Geometry)
deconstruct_brep_2 = DeconstructBrep(Brep=brep_2)  # -> Faces, Edges, Vertices
curve_closest_point_3 = CurveClosestPoint(Point=flatten(curve_closest_point_2.Point), Curve=deconstruct_brep_2.Edges)  # -> Point, Parameter, Distance
sort_list_2 = SortList(Keys=curve_closest_point_3.Distance, ValuesValuesA=deconstruct_brep_2.Edges)  # -> Keys, ValuesValuesA
list_item_17 = ListItem(List=flatten(sort_list_2.ValuesValuesA), Index=0, Wrap=True)
curve_4 = Curve(list_item_17)

# ---- group: 12. Visualising information bus stop
concatenate = Concatenate(
    Fragment_A=panel_27,
    Fragment_B=":",
    C=" Population: ",
    D=total_population_selected_voronoi,
    E=" people (15-65 years old) within ",
    G=" meter radius of the bus stop.")
text = ColourSwatch(SwatchColor=RGB(0, 0, 0))
panel_30 = Panel(concatenate)
# Important datadams!
text_tag = TextTag(Location=closest_point.ClosestPoint, Text=concatenate, Colour=text)

# ----
curve_5 = Curve(flatten(cull_pattern))
data_dam = DataDam(
    DataVoronoi=voronoi,
    DataContext=brep,
    DataBVBusStop=move.Geometry,
    DataCurveClosestSideToTheBusStop=curve_4,
    DataVisualizedData=panel_30,
    DataBusRoutes=deconstruct_speckle_object_8,
    DataFootprints=curve_5,
    BufferDelay=2500000,
    BufferMode=0)  # -> DataVoronoi, flatten(DataContext), DataBVBusStop, DataCurveClosestSideToTheBusStop, DataVisualizedData, DataBusRoutes, DataFootprints
data = Data(data_dam.DataContext)
data_2 = Data(data_dam.DataBVBusStop)
data_3 = Data(data_dam.DataCurveClosestSideToTheBusStop)
data_4 = Data(data_dam.DataFootprints)
data_5 = Data(data_dam.DataVisualizedData)
data_6 = Data(data_dam.DataBusRoutes)
mesh_brep = MeshBrep(
    Brep=data,
    Settings={GridMaxCount=0, GridMinCount=16, JaggedSeams=False, MaxEdgeLength=0, MinEdgeLength=0.0001, MinTolerance=0, Refine=True, RefineAngle=0, RelativeTolerance=0.65, SimplePlanes=True, Tolerance=0})  # -> simplify(Mesh)

# ---- group: Center point bot bbox
data_7 = Data(data_2)
data_8 = Data(data_3)
data_9 = Data(data_2)
data_10 = Data(data_3)
deconstruct_box = DeconstructBox(Box=data_7)  # -> Plane, X, Y, Z
deconstruct_box_2 = DeconstructBox(Box=data_9)  # -> Plane, X, Y, Z
point_5 = Point(deconstruct_box.Plane)
point_6 = Point(deconstruct_box_2.Plane)
xy_plane_2 = XYPlane(Origin=point_6)
unit_z_2 = UnitZ(Factor=Slider(50000, range=0..50000))
circle = Circle(Plane=xy_plane_2, Radius=Slider(50000, range=0..100000))
extrude_2 = Extrude(Base=circle, Direction=unit_z_2)
trim_with_region = TrimWithRegion(Curve=data_6, Region=circle)  # -> flatten(Inside), Outside
brep_3 = Brep(extrude_2)
curve_6 = Curve(trim_with_region.Inside)
solid_difference = SolidDifference(BrepsA=data, BrepsB=brep_3)
pipe = Pipe(Curve=[curve_6, circle], Radius=Slider(10, range=0..100), Caps=0)
brep_4 = Brep(solid_difference)
area_8 = Area(Geometry=brep_4)  # -> Area, Centroid
point_in_curve_6 = PointInCurve(Point=area_8.Centroid, Curve=graft(circle))  # -> Relationship, Point
equality_6 = Equality(FirstNumber=flatten(point_in_curve_6.Relationship), SecondNumber=2)  # -> Equality, Inequality
dispatch_7 = Dispatch(List=flatten(brep_4), DispatchPattern=equality_6.Inequality)  # -> ListA, ListB
brep_5 = Brep(dispatch_7.ListB)

# ---- group: Box
brep_6 = Brep(data_2)

# ----
brep_7 = Brep(data_7)
project = Project(Geometry=brep_7, Plane=PlaneXY(0, 0, 0))  # -> Geometry, Transform
brep_edges = BrepEdges(Brep=project.Geometry)  # -> Naked, Interior, NonManifold
join_curves = JoinCurves(Curves=brep_edges.Interior, Preserve=False)
region_union = RegionUnion(Curves=join_curves)
unit_z_3 = UnitZ(Factor=Slider(100000, range=0..100000))
extrude_3 = Extrude(Base=region_union, Direction=unit_z_3)
multiplication_2 = Multiplication(A=unit_z_3, B=" -0.5")
move_2 = Move(Geometry=extrude_3, Motion=multiplication_2)  # -> Geometry, Transform
cap_holes = CapHoles(Brep=move_2.Geometry)

# ----
# OPEN FRONT
# WALL SHAPE
# LOOPED_TRUSS
false_rectangle_2 = BooleanToggle(False)
number_slider_24 = Slider(60, range=0..90)
concatenate_2 = Concatenate(A=panel_6, B=panel_5, C=panel_7, E=panel_8, F=panel_9, G=panel_10)

addition_3 = Addition(A=" 90", B=number_slider_24)
subtraction_5 = Subtraction(A=" 90", B=number_slider_24)
radians = Radians(Degrees=addition_3)
radians_2 = Radians(Degrees=subtraction_5)
box = Box(data_2)
construct_domain_4 = ConstructDomain(DomainStart=radians, DomainEnd=radians_2)
deconstruct_box_3 = DeconstructBox(Box=box)  # -> Plane, X, Y, Z
arc = Arc(Plane=deconstruct_box_3.Plane, Radius=Slider(6242, range=0..10000), Angle=construct_domain_4)  # -> Arc, Length
end_points = EndPoints(Curve=arc.Arc)  # -> Start, End
line_2 = Line(StartPoint=deconstruct_box_3.Plane, EndPoint=end_points.Start)
line_3 = Line(StartPoint=deconstruct_box_3.Plane, EndPoint=end_points.End)
boundary_surfaces_2 = BoundarySurfaces(Edges=[line_2, line_3, arc.Arc])
custom_preview_3 = CustomPreview(Geometry=boundary_surfaces_2, Material=ColourSwatch(SwatchColor=RGB(194, 66, 66)))

number_slider_25 = Slider(5000, range=0..10000)

open_front = Surface(boundary_surfaces_2)
brep_edges_2 = BrepEdges(Brep=open_front)  # -> Naked, Interior, NonManifold
join_curves_2 = JoinCurves(Curves=brep_edges_2.Naked, Preserve=False)  # -> simplify(flatten(Curves))
unit_z_4 = UnitZ(Factor=height_bounding_volume_bus_stop)

panel_31 = Panel(join_curves_2)

# ---- group: Rotating 90 degrees and flipping from anti clockwise to clockwise
unit_z_5 = UnitZ(Factor=1)
radians_3 = Radians(Degrees=" 90")

# ----
number_slider_26 = Slider(72, range=0..100)

division_4 = Division(A="360", B=number_slider_26)
division_5 = Division(A=division_4, B="2")
panel_32 = Panel(division_4)
negative = Negative(Value=division_5)
panel_33 = Panel(number_slider_26)
panel_34 = Panel(negative)
series_3 = Series(Start=panel_34, Step=panel_32, Count=panel_33)  # -> simplify(graft(Series))

deconstruct_brep_3 = DeconstructBrep(Brep=brep_6)  # -> Faces, Edges, Vertices
project_2 = Project(Geometry=brep_6, Plane=PlaneXY(0, 0, 0))  # -> Geometry, Transform
deconstruct_box_4 = DeconstructBox(Box=data_2)  # -> Plane, X, Y, Z
list_item_18 = ListItem(List=deconstruct_brep_3.Faces, Index=5, Wrap=True)
list_item_19 = ListItem(List=deconstruct_brep_3.Faces, Index=4, Wrap=True)
area_9 = Area(Geometry=project_2.Geometry)  # -> Area, Centroid
ellipse = Ellipse(Plane=deconstruct_box_4.Plane, Radius1=expr("x*0.5", construct_domain_2), Radius2=construct_domain_3)  # -> Ellipse, Focus1, Focus2
area_10 = Area(Geometry=list_item_18)  # -> Area, Centroid
xy_plane_3 = XYPlane(Origin=area_9.Centroid)
circle_2 = Circle(Plane=xy_plane_3, Radius=Slider(6000, range=0..10000))

# ---- group: Rectangle roof
curve_7 = Curve(list_item_18)

# ---- group: Rectangle base
curve_8 = Curve(list_item_19)

# ----
point_7 = Point(area_10.Centroid)

# ---- group: Degrees
divide_curve = DivideCurve(Curve=circle_2, Count=Slider(360, range=0..360), Kinks=False)  # -> flatten(Points), Tangents, Parameters

# ----
area_11 = Area(Geometry=curve_8)  # -> Area, Centroid
entwine = Entwine(Branch00=curve_8, Branch01=ellipse.Ellipse, FlattenInputs=True)  # -> simplify(Result)
curve_closest_point_4 = CurveClosestPoint(Point=flatten(area_11.Centroid), Curve=deconstruct_brep_3.Edges)  # -> Point, Parameter, Distance
tree_branch = TreeBranch(Tree=entwine, Path=false_rectangle_2, MaintainPaths=True)
sort_list_3 = SortList(Keys=curve_closest_point_4.Distance, ValuesValuesA=deconstruct_brep_3.Edges)  # -> Keys, ValuesValuesA
line_4 = Line(StartPoint=area_9.Centroid, EndPoint=divide_curve.Points)
list_item_20 = ListItem(List=flatten(sort_list_3.ValuesValuesA), Index=0, Wrap=True)
shift_list = ShiftList(List=line_4, Shift=90, Wrap=True)
divide_curve_2 = DivideCurve(Curve=list_item_20, Count=Slider(20, range=0..20), Kinks=False)  # -> Points, Tangents, Parameters
dispatch_8 = Dispatch(List=divide_curve_2.Points, DispatchPattern=[True, False])  # -> ListA, ListB
point_8 = Point(dispatch_8.ListB)
interpolate = Interpolate(Vertices=point_8, Degree=Slider(3, range=0..100), Periodic=False, KnotStyle=1)  # -> Curve, Length, Domain
curve_9 = Curve(interpolate.Curve)

point_9 = Point(area_11.Centroid)
circle_cnr = CircleCNR(Center=point_9, Normal=Vector(0, 0, 1), Radius=" 100000")
divide_curve_3 = DivideCurve(Curve=circle_cnr, Count=number_slider_26, Kinks=False)  # -> Points, Tangents, Parameters

# ---- group: Rotating 90 degrees and flipping from anti clockwise to clockwise (continued)
move_3 = Move(Geometry=point_9, Motion=unit_z_5)  # -> Geometry, Transform
line_5 = Line(StartPoint=point_9, EndPoint=move_3.Geometry)
rotate_axis = RotateAxis(Geometry=divide_curve_3.Points, Angle=radians_3, Axis=line_5)  # -> Geometry, Transform
reverse_list = ReverseList(List=rotate_axis.Geometry)
shift_list_2 = ShiftList(List=reverse_list, Shift=" -1", Wrap=True)

# ----
point_10 = Point(deconstruct_box_4.Plane)
circle_3 = Circle(Plane=point_10, Radius="100000")
circle_4 = Circle(Plane=point_10, Radius="20000")
xy_plane_4 = XYPlane(Origin=Point(0, 0, 0))
curve_10 = Curve(data_6)
trim_with_region_2 = TrimWithRegion(Curve=curve_10, Region=circle_3, Plane=xy_plane_4)  # -> Inside, Outside
trim_with_region_3 = TrimWithRegion(Curve=trim_with_region_2.Inside, Region=circle_4, Plane=xy_plane_4)  # -> Inside, Outside
viewing_height = Slider(1500, range=0..10000)
cluster = Cluster(curve=trim_with_region_3.Outside)
unit_z_6 = UnitZ(Factor=viewing_height)
unit_z_7 = UnitZ(Factor=number_slider_8)
point_11 = Point(point_7)
move_4 = Move(Geometry=point_11, Motion=unit_z_7)  # -> Geometry, Transform
brep_8 = Brep(data)

line_6 = Line(StartPoint=point_9, EndPoint=shift_list_2)  # -> graft(Line)
curve_curve = CurveCurve(CurveA=simplify(data_4), CurveB=simplify(line_6))  # -> Points, ParamsA, ParamsB
path_mapper = PathMapper(curve_curve.Points, source="{A;B}", target="{A}")
distance = Distance(PointA=point_9, PointB=path_mapper)
sort_list_4 = SortList(Keys=distance, ValuesValuesA=path_mapper)  # -> Keys, ValuesValuesA
list_item_21 = ListItem(List=sort_list_4.ValuesValuesA, Index=0, Wrap=True)

sort_list_5 = SortList(Keys=distance)  # -> Keys, ValuesValuesA

list_item_22 = ListItem(List=sort_list_5.Keys, Index=0, Wrap=True)
null_item = NullItem(Item=list_item_22)  # -> NullFlags, InvalidFlags, Description
weave = Weave(Pattern=null_item.NullFlags, Stream0=list_item_22, Stream1=" 100000", NullGaps=False)  # -> flatten(Weave)
weave_2 = Weave(Pattern=null_item.NullFlags, Stream0=list_item_21, Stream1=graft(shift_list_2), NullGaps=False)
larger_than = LargerThan(FirstNumber=weave, SecondNumber=stream_filter_2)  # -> LargerThan, OrEqualTo
line_7 = Line(StartPoint=point_9, EndPoint=weave_2)

cull_pattern_3 = CullPattern(List=flatten(line_7), CullPattern=larger_than.LargerThan)
cull_pattern_4 = CullPattern(List=simplify(series_3), CullPattern=simplify(graft(larger_than.LargerThan)))
flatten_tree = FlattenTree(Tree=cull_pattern_4, Path="{0}")  # -> simplify(flatten(Tree))
domain_size = Panel(panel_32)
ghpython_script_3 = GhPythonScript(x=flatten_tree, y=domain_size)  # -> out, a; inputs x: list
# ---------- ghpython_script_3: Python ----------
__author__ = "sande"
__version__ = "2024.01.04"

import rhinoscriptsyntax as rs
import Grasshopper as gh

def listToTree(nestedList):
    # https://discourse.mcneel.com/t/outputting-a-nested-python-list-as-tree/48188
    """ Convert a nested python iterable to a datatree """
    
    dt = gh.DataTree[object]()
    for i,l in enumerate(nestedList):
        dt.AddRange(l,gh.Kernel.Data.GH_Path(i))
        
    return dt

x = [float(i) for i in x]

output = []
temp_list = []

domain_size = float(y)

print(x)

for i in range(len(x)):
    if len(temp_list) == 0:
        temp_list.append(x[i])
        temp_list.append(x[i] + domain_size)
        continue
    if temp_list[-1] == x[i]:
        temp_list[-1] = x[i] + domain_size
    else:
        output.append(temp_list)
        temp_list = []
        temp_list.append(x[i])
        temp_list.append(x[i] + domain_size)
        continue

output.append(temp_list)

a = listToTree(output)
# ---------- end ghpython_script_3 ----------
angles = Panel(ghpython_script_3.a)

negative_2 = Negative(Value=angles)  # disabled
panel_35 = Panel(" 90")  # disabled
addition_4 = Addition(A=negative_2, B=panel_35)  # disabled
radians_4 = Radians(Degrees=addition_4)  # disabled
cosine = Cosine(Value=radians_4)  # disabled
sine = Sine(Value=radians_4)  # disabled
panel_36 = Panel(cosine)  # disabled
panel_37 = Panel(sine)  # disabled
vector_xyz = VectorXYZ(XComponent=panel_36, YComponent=panel_37, ZComponent=0)  # -> Vector, Length; disabled
number_slider_27 = Slider(70000, range=0..100000)  # disabled
panel_38 = Panel(vector_xyz.Vector)  # disabled
multiplication_3 = Multiplication(A=number_slider_27, B=vector_xyz.Vector)  # disabled
move_5 = Move(Geometry=point_9, Motion=multiplication_3)  # -> Geometry, Transform; disabled
line_8 = Line(StartPoint=circle_2, EndPoint=move_5.Geometry)  # disabled
shift_list_3 = ShiftList(List=move_5.Geometry, Shift=1, Wrap=True)  # disabled

transparancy = Panel(ghpython_script_3.a)
negative_3 = Negative(Value=transparancy)
addition_5 = Addition(A=negative_3, B=" 90")
radians_5 = Radians(Degrees=addition_5)
list_item_23 = ListItem(List=radians_5, Index=0, Wrap=True)  # -> Item, Item1
construct_domain_5 = ConstructDomain(DomainStart=list_item_23.Item, DomainEnd=list_item_23.Item1)
arc_2 = Arc(Plane=point_5, Radius=number_slider_25, Angle=construct_domain_5)  # -> simplify(Arc), Length
join_curves_3 = JoinCurves(Curves=flatten(arc_2.Arc), Preserve=False)  # -> simplify(graft(Curves))
end_points_2 = EndPoints(Curve=join_curves_3)  # -> Start, End
line_9 = Line(StartPoint=point_5, EndPoint=end_points_2.Start)  # -> simplify(Line)
line_10 = Line(StartPoint=point_5, EndPoint=end_points_2.End)  # -> simplify(Line)
join_curves_4 = JoinCurves(Curves=[line_9, line_10, join_curves_3], Preserve=False)
boundary_surfaces_3 = BoundarySurfaces(Edges=join_curves_4)

windows = Surface(boundary_surfaces_3)
brep_edges_3 = BrepEdges(Brep=windows)  # -> Naked, Interior, NonManifold
join_curves_5 = JoinCurves(Curves=brep_edges_3.Naked, Preserve=False)  # -> simplify(flatten(Curves))
curve_11 = Curve(simplify(graft(join_curves_5)))

number_slider_28 = Slider(3, range=0..5)  # disabled
number_slider_29 = Slider(1, range=0..1)  # disabled
number_slider_30 = Slider(0.02, range=0..0.05, expression="X*1000")  # disabled
colour_swatch = ColourSwatch(SwatchColor=RGB(80, 94, 92))  # disabled

data_dam_2 = DataDam(DataDataA=analysisperiod.hoys, BufferDelay=10000000, BufferMode=0)
mesh_brep_2 = MeshBrep(
    Brep=data,
    Settings={GridMaxCount=0, GridMinCount=16, JaggedSeams=False, MaxEdgeLength=0, MinEdgeLength=0.0001, MinTolerance=0, Refine=True, RefineAngle=0, RelativeTolerance=0.65, SimplePlanes=True, Tolerance=0})  # -> graft(Mesh)

number_slider_31 = Slider(1, range=0..1)
point_12 = Point(point_7)

number_slider_32 = Slider(2000, range=0..10000)

panel_39 = Panel("https://climate.onebuilding.org/WMO_Region_6_Europe/NLD_Netherlands/ZH_Zuid-Holland/NLD_ZH_Ypenburg.062000_TMYx.zip")
downloadepw = LBDownloadWeather(weather_URL=panel_39)  # -> epw_file, stat_file, ddy_file; plug-in component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
importepw = LBImportEPW(epw_file=downloadepw.epw_file)  # -> location, dry_bulb_temperature, dew_point_temperature, relative_humidity, wind_speed, wind_direction, direct_normal_rad, diffuse_horizontal_rad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; plug-in component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
analysisperiod_2 = LBAnalysisPeriod(start_month=Slider(1, range=1..12), start_day=1, start_hour=0, end_month=Slider(12, range=1..12))  # -> period, hoys, dates; plug-in component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
unit_y = UnitY(Factor=1)

area_12 = Area(Geometry=tree_branch)  # -> Area, Centroid
series_4 = Series(Start="-5", Step="10", Count=" 36")  # -> simplify(graft(Series))
wind_angles = Panel(series_4)
domain_size_2 = Panel("10")
point_13 = Point(area_11.Centroid)

windrose = LBWindRose(
    north=unit_y,
    data=importepw.wind_speed,
    wind_direction=importepw.wind_direction,
    center_pt=area_12.Centroid,
    period=analysisperiod_2.period)  # -> out, mesh, compass, orient_line, freq_line, windrose_line, legend, title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; plug-in component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

curve_devision_length = Slider(20000, range=0..100000)

divide_length = DivideLength(Curve=cluster, Length=curve_devision_length)  # -> Points, Tangents, Parameters
move_6 = Move(Geometry=flatten(divide_length.Points), Motion=unit_z_6)  # -> Geometry, Transform
line_11 = Line(StartPoint=move_4.Geometry, EndPoint=move_6.Geometry)
vector_2pt = Vector2Pt(PointA=move_4.Geometry, PointB=move_6.Geometry, Unitize=Toggle(True))  # -> Vector, Length

# ---- group: Check if building is in between
collision_one_many = CollisionOneMany(Collider=line_11, Obstacles=brep_8)  # -> Collision, Index

# ----
gate_not = GateNot(A=collision_one_many.Collision)
cull_pattern_5 = CullPattern(List=vector_2pt.Vector, CullPattern=gate_not)

# ---- group: Vector preview
cull_pattern_6 = CullPattern(List=line_11, CullPattern=gate_not)  # -> flatten(List)

# ----
list_length = ListLength(List=cull_pattern_5)
panel_40 = Panel(list_length)

reduction_factor = Slider(0.95, range=0.8..1)

point_14 = Point(point_5)

xmatrix = LBDeconstructMatrix(matrix=flatten(windrose.histogram))  # -> values; plug-in component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
mass_addition_5 = MassAddition(Input=xmatrix)  # -> flatten(Result), PartialResults
wind_values = Panel(mass_addition_5.Result)
larger_than_2 = LargerThan(FirstNumber=wind_values, SecondNumber=stream_filter)  # -> LargerThan, OrEqualTo
cull_pattern_7 = CullPattern(List=simplify(wind_angles), CullPattern=simplify(graft(larger_than_2.LargerThan)))
panel_41 = Panel(cull_pattern_7)
flatten_tree_2 = FlattenTree(Tree=panel_41, Path="{0}")  # -> simplify(flatten(Tree))
ghpython_script_4 = GhPythonScript(x=flatten_tree_2, y=domain_size_2)  # -> out, a; inputs x: list; same code as ghpython_script_3
panel_42 = Panel(ghpython_script_4.a)

# ---- group: Angles
panel_43 = Panel(panel_42)

# ----
wind_walls = Panel(panel_43)
negative_4 = Negative(Value=wind_walls)
addition_6 = Addition(A=negative_4, B=" 90")
radians_6 = Radians(Degrees=addition_6)
list_item_24 = ListItem(List=radians_6, Index=0, Wrap=True)  # -> Item, Item1
construct_domain_6 = ConstructDomain(DomainStart=list_item_24.Item, DomainEnd=list_item_24.Item1)
arc_3 = Arc(Plane=point_5, Radius=number_slider_25, Angle=construct_domain_6)  # -> simplify(Arc), Length
join_curves_6 = JoinCurves(Curves=flatten(arc_3.Arc), Preserve=False)  # -> simplify(graft(Curves))
end_points_3 = EndPoints(Curve=join_curves_6)  # -> Start, End
line_12 = Line(StartPoint=point_5, EndPoint=end_points_3.Start)  # -> simplify(Line)
line_13 = Line(StartPoint=point_5, EndPoint=end_points_3.End)  # -> simplify(Line)
join_curves_7 = JoinCurves(Curves=[join_curves_6, line_13, line_12], Preserve=False)
panel_44 = Panel(arc_3.Arc)
boundary_surfaces_4 = BoundarySurfaces(Edges=join_curves_7)

region_difference = RegionDifference(CurvesA=boundary_surfaces_4, CurvesB=open_front)
walls = Surface(boundary_surfaces_4)
boundary_surfaces_5 = BoundarySurfaces(Edges=region_difference)

brep_edges_4 = BrepEdges(Brep=walls)  # -> Naked, Interior, NonManifold
join_curves_8 = JoinCurves(Curves=brep_edges_4.Naked, Preserve=False)

number_slider_33 = Slider(20, range=0..100)  # disabled
number_slider_34 = Slider(20, range=0..100)  # disabled
md_slider_2 = MDSlider(SliderMode=0, slider_value=Point(0.5, 0.5, 0.5), x_domain=Domain(0, 1), y_domain=Domain(0, 1), z_domain=Domain(0, 1))  # disabled
md_slider_3 = MDSlider(SliderMode=0, slider_value=Point(0.5, 0.5, 0.5), x_domain=Domain(0, 1), y_domain=Domain(0, 1), z_domain=Domain(0, 1))  # disabled
number_slider_35 = Slider(100, range=0..100)  # disabled
number_slider_36 = Slider(20, range=0..100)  # disabled
number_slider_37 = Slider(20, range=0..100)  # disabled
number_slider_38 = Slider(100, range=0..100)  # disabled

unit_z_8 = UnitZ(Factor=1)
unit_z_9 = UnitZ(Factor=1)
negative_5 = Negative(Value=Slider(0.54, range=0..1))

number_slider_39 = Slider(50, range=0..100)

# ---- group: N-S simulation
radians_7 = Radians(Degrees=Slider(78, range=0..100))
negative_6 = Negative(Value=radians_7)

# ---- group: Dirty visualization
negative_7 = Negative(Value=panel_43)
addition_7 = Addition(A=negative_7, B=" 90")
radians_8 = Radians(Degrees=addition_7)
cosine_2 = Cosine(Value=radians_8)
sine_2 = Sine(Value=radians_8)
panel_45 = Panel(cosine_2)
panel_46 = Panel(sine_2)
vector_xyz_2 = VectorXYZ(XComponent=panel_45, YComponent=panel_46, ZComponent=0)  # -> Vector, Length
multiplication_4 = Multiplication(A=Slider(20, range=0..100000), B=vector_xyz_2.Vector)
panel_47 = Panel(vector_xyz_2.Vector)
move_7 = Move(Geometry=point_13, Motion=multiplication_4)  # -> Geometry, Transform
shift_list_4 = ShiftList(List=move_7.Geometry, Shift=1, Wrap=True)
line_14 = Line(StartPoint=point_13, EndPoint=move_7.Geometry)

# ----
list_item_25 = ListItem(List=panel_47, Index=0, Wrap=True)  # -> Item, Item1

# ---- group: Dirty visualization (continued)
addition_8 = Addition(A=list_item_25.Item, B=list_item_25.Item1)

# ----
curve_middle = CurveMiddle(Curve=data_8)
end_points_4 = EndPoints(Curve=data_8)  # -> Start, End
vector_2pt_2 = Vector2Pt(PointA=curve_middle, PointB=point_5, Unitize=False)  # -> Vector, Length
vector_2pt_3 = Vector2Pt(PointA=end_points_4.Start, PointB=end_points_4.End, Unitize=False)  # -> Vector, Length
move_8 = Move(Geometry=data_8, Motion=vector_2pt_2.Vector)  # -> Geometry, Transform
plane_normal = PlaneNormal(Origin=curve_middle, ZAxis=vector_2pt_3.Vector)
radians_9 = Radians(Degrees=Slider(180, range=0..1000))

settings_quality = SettingsQuality()  # disabled
wall = Butterfly_WallBoundary()  # -> wall_boundary; disabled; plug-in component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
number_slider_40 = Slider(4, range=0..10)  # disabled
number_slider_41 = Slider(4, range=0..10)  # disabled
number_slider_42 = Slider(4, range=0..10)  # disabled
number_slider_43 = Slider(5, range=0..10)  # disabled
vector = Vector(expr("-x", addition_8))  # disabled
panel_48 = Panel("3,6")  # disabled
number_3 = Number(expr("x/1000", stream_filter))  # disabled
settings_quality_2 = SettingsQuality()  # disabled
panel_49 = Panel("walls")  # disabled
panel_50 = Panel("4")  # disabled
windvector = Butterfly_WindVector(wind_speed=number_3, wind_direction=vector)  # -> wind_vector; disabled; plug-in component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
tunnelparams = Butterfly_WindTunnelParameters(windward_x=number_slider_40, top_x=number_slider_41, sides_x=number_slider_42, leeward_x=number_slider_43)  # -> out, tunnel_params; disabled; plug-in component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
boolean_toggle_5 = BooleanToggle(True)  # disabled
panel_51 = Panel("tunnel2")  # disabled
boolean_toggle_6 = BooleanToggle(True)  # disabled
boolean_toggle_7 = BooleanToggle(True)  # disabled
boolean_toggle_8 = BooleanToggle(False)  # disabled
number_slider_44 = Slider(10, range=0..10, expression="x*1000")  # disabled
number_slider_45 = Slider(10, range=0..10, expression="x*1000")  # disabled
number_slider_46 = Slider(7, range=0..10, expression="x*1000")  # disabled
number_slider_47 = Slider(1.5, range=0..10)  # disabled
center_box = CenterBox(Base=point_5, X=number_slider_44, Y=number_slider_45, Z=number_slider_46)  # disabled
box_2 = Box(center_box)  # disabled
genpts = LBGeneratePointGrid(geometry=box_2, grid_size=number_slider_47)  # -> points, vectors, face_areas, mesh; disabled; plug-in component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
boolean_toggle_9 = BooleanToggle(True)  # disabled
boolean_toggle_10 = BooleanToggle(True)  # disabled
panel_52 = Panel("600")  # disabled
panel_53 = Panel("3,3")  # disabled
point_15 = Point(genpts.points)  # disabled
panel_54 = Panel("U")  # disabled
controldict = Butterfly_controlDict(start_time=0, end_time=panel_52, write_interval=100, write_compression=False, purge_write=0)  # -> control_dict; disabled; plug-in component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
probes = Butterfly_probes(points=point_15, fields=panel_54)  # -> probes; disabled; plug-in component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
boolean_toggle_11 = BooleanToggle(True)  # disabled
solutionparams = Butterfly_SolutionParameters(control_dict=controldict, probes=probes)  # -> solution_par; disabled; plug-in component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
steadyincomp = Butterfly_SteadyIncompressibleRecipe()  # -> out, recipe; disabled; plug-in component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
boolean_toggle_12 = BooleanToggle(True)  # disabled
panel_55 = Panel("U")  # disabled
number_slider_48 = Slider(3.27, range=0..10)  # disabled
point_16 = Point(genpts.points)  # disabled

gene_pool_n_s = GenePool(Decimals=2, Maximum=1, Minimum=-1, Value=[-0.24, 0.29, 0.39, 0.1, -0.36])
list_item_26 = ListItem(List=gene_pool_n_s, Index=0, Wrap=True)  # -> Item, Item1, Item2, Item3, Item4
settings_speed = SettingsSpeed()
unit_z_10 = UnitZ(Factor=Slider(0.1, range=0..0.1))
unit_z_11 = UnitZ(Factor=1)

panel_56 = Panel("https://energyplus-weather.s3.amazonaws.com/europe_wmo_region_6/NLD/NLD_Amsterdam.062400_IWEC/NLD_Amsterdam.062400_IWEC.zip")
downloadepw_2 = LBDownloadWeather(weather_URL=panel_56)  # -> epw_file, stat_file, ddy_file; plug-in component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
analysisperiod_3 = LBAnalysisPeriod(
    start_month=Slider(1, range=1..12),
    start_day=Slider(1, range=1..31),
    start_hour=Slider(0, range=0..23),
    end_month=Slider(12, range=1..12),
    end_day=Slider(31, range=1..31),
    end_hour=Slider(23, range=0..23),
    timestep=Slider(1, range=1..6))  # -> period, hoys, dates; plug-in component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
number_slider_49 = Slider(1, range=1..5)
importepw_2 = LBImportEPW(epw_file=downloadepw_2.epw_file)  # -> location, dry_bulb_temperature, dew_point_temperature, relative_humidity, wind_speed, wind_direction, direct_normal_rad, diffuse_horizontal_rad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; plug-in component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
data_dam_3 = DataDam(DataDataA=analysisperiod_3.hoys, BufferDelay=10000000, BufferMode=0)

importepw_3 = LBImportEPW(epw_file=downloadepw_2.epw_file)  # -> location, dry_bulb_temperature, dew_point_temperature, relative_humidity, wind_speed, wind_direction, direct_normal_rad, diffuse_horizontal_rad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; plug-in component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
sunpath = LBSunPath(location=importepw_3.location, hoys=data_dam_2, scale=1)  # -> out, simplify(vectors), altitudes, azimuths, simplify(hoys), sun_pts, analemma, daily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; plug-in component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
reverse = Reverse(Vector=flatten(sunpath.vectors))
mesh_ray = MeshRay(Mesh=mesh_brep_2, Point=point_5, Direction=reverse)  # -> Point, simplify(Hit)
flip_matrix = FlipMatrix(Data=mesh_ray.Hit)
mass_addition_6 = MassAddition(Input=flip_matrix)  # -> flatten(Result), PartialResults
tree_statistics = TreeStatistics(Tree=sunpath.hoys)  # -> Paths, Length, Count
gate_not_2 = GateNot(A=mass_addition_6.Result)
partition_list = PartitionList(List=gate_not_2, Size=tree_statistics.Length)
cull_pattern_8 = CullPattern(List=sunpath.hoys, CullPattern=partition_list)
sunpath_2 = LBSunPath(location=importepw_3.location, hoys=cull_pattern_8, center_pt=point_5, scale=1)  # -> out, vectors, altitudes, azimuths, hoys, sun_pts, analemma, daily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; plug-in component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
skymatrix = LBCumulativeSkyMatrix(
    location=importepw_3.location,
    direct_rad=importepw_3.direct_normal_rad,
    diffuse_rad=importepw_3.diffuse_horizontal_rad,
    hoys=sunpath_2.hoys)  # -> out, sky_mtx; plug-in component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
skydome = LBSkyDome(sky_mtx=skymatrix.sky_mtx)  # -> out, mesh, compass, legend, title, patch_vecs, patch_values, mesh_values, vis_set; plug-in component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

multiplication_5 = Multiplication(A=skydome.patch_vecs, B=skydome.patch_values)
panel_57 = Panel(skydome.patch_values)
mass_addition_7 = MassAddition(Input=multiplication_5)  # -> Result, PartialResults
sort_list_6 = SortList(Keys=panel_57, ValuesValuesA=skydome.patch_values)  # -> Keys, ValuesValuesA
panel_58 = Panel(sort_list_6.Keys)
panel_59 = Panel(sort_list_6.ValuesValuesA)
list_item_27 = ListItem(List=panel_59, Index="-1", Wrap=True)

# ---- group: Surface normals
unit_vector = UnitVector(Vector=mass_addition_7.Result)

# ----
plane_normal_2 = PlaneNormal(Origin=point_5, ZAxis=unit_vector)
multiplication_6 = Multiplication(A=unit_vector, B=Slider(242788, range=0..1000000))
move_9 = Move(Geometry=point_14, Motion=multiplication_6)  # -> Geometry, Transform
line_15 = Line(StartPoint=point_14, EndPoint=move_9.Geometry)

construct_plane = ConstructPlane(Origin=point_5, XAxis=unit_z_8, YAxis=unit_vector)
angle = Angle(VectorA=unit_vector, VectorB=unit_z_9)  # -> Angle, Reflex
deconstruct_plane = DeconstructPlane(Plane=construct_plane)  # -> Origin, XAxis, YAxis, ZAxis
degrees = Degrees(Radians=angle.Angle)
move_10 = Move(Geometry=deconstruct_plane.Origin, Motion=deconstruct_plane.ZAxis)  # -> Geometry, Transform
panel_60 = Panel(degrees)
line_16 = Line(StartPoint=deconstruct_plane.Origin, EndPoint=move_10.Geometry)
subtraction_6 = Subtraction(A=Slider(20, range=0..30), B=degrees)
multiplication_7 = Multiplication(A=negative_5, B=panel_60)
radians_10 = Radians(Degrees=multiplication_7)
rotate_axis_2 = RotateAxis(Geometry=plane_normal_2, Angle=radians_10, Axis=line_16)  # -> Geometry, Transform
rotate_axis_3 = RotateAxis(Geometry=line_15, Angle=radians_10, Axis=line_16)  # -> Geometry, Transform
plane = Plane(rotate_axis_2.Geometry)

# ---- group: N-S simulation (continued)
rotate = Rotate(Geometry=rotate_axis_2.Geometry, Angle=negative_6, Plane=point_5)  # -> Geometry, Transform

# ----
brep_plane = BrepPlane(Brep=cap_holes, Plane=plane)  # -> Curves, Points
boundary_surfaces_6 = BoundarySurfaces(Edges=brep_plane.Curves)  # -> flatten(Surfaces)
group = Group(Objects=boundary_surfaces_6)
bounding_box = BoundingBox(Content=group, Plane=PlaneXY(0, 0, 0))  # -> Box, Box_2
deconstruct_box_5 = DeconstructBox(Box=bounding_box.Box)  # -> Plane, X, Y, Z
deconstruct_domain = DeconstructDomain(Domain=deconstruct_box_5.Z)  # -> Start, End
subtraction_7 = Subtraction(A=deconstruct_domain.End, B=deconstruct_domain.Start)

panel_61 = Panel(subtraction_7)
division_6 = Division(A=panel_61, B="4")
brep_plane_2 = BrepPlane(Brep=cap_holes, Plane=plane)  # -> Curves, Points
multiplication_8 = Multiplication(A=division_6, B=[list_item_26.Item, list_item_26.Item1, list_item_26.Item2, list_item_26.Item3, list_item_26.Item4])
boundary_surfaces_7 = BoundarySurfaces(Edges=brep_plane_2.Curves)  # -> flatten(Surfaces)
unit_z_12 = UnitZ(Factor=multiplication_8)
move_11 = Move(Geometry=boundary_surfaces_7, Motion=unit_z_12)  # -> Geometry, Transform
shift_list_5 = ShiftList(List=move_11.Geometry, Shift=1, Wrap=True)
split_brep_multiple = SplitBrepMultiple(Brep=move_11.Geometry, Cutters=shift_list_5)
flatten_tree_3 = FlattenTree(Tree=split_brep_multiple, Path="{0}")
mesh_brep_3 = MeshBrep(Brep=flatten_tree_3, Settings=settings_speed)
area_13 = Area(Geometry=flatten_tree_3)  # -> Area, Centroid
move_12 = Move(Geometry=area_13.Centroid, Motion=unit_z_10)  # -> Geometry, Transform
mesh_ray_2 = MeshRay(Mesh=mesh_brep_3, Point=graft(move_12.Geometry), Direction=unit_z_11)  # -> Point, Hit
mass_addition_8 = MassAddition(Input=mesh_ray_2.Hit)  # -> flatten(Result), PartialResults
boolean = Boolean(mass_addition_8.Result)
gate_not_3 = GateNot(A=boolean)
cull_pattern_9 = CullPattern(List=flatten(flatten_tree_3), CullPattern=gate_not_3)

data_dam_4 = DataDam(DataDataA=unit_z_12, BufferDelay=10000000, BufferMode=0)
cluster_2 = Cluster_2(curve=region_union, distance=number_slider_5, motion=data_dam_4, plane=plane)  # -> tree, result
cluster_3 = Cluster_2(curve=ellipse.Ellipse, distance=number_slider_5, motion=data_dam_4, plane=plane)  # -> tree, result
cull_pattern_10 = CullPattern(List=flatten(cluster_2.tree), CullPattern=cluster_2.result)
cull_pattern_11 = CullPattern(List=flatten(cluster_3.tree), CullPattern=cluster_3.result)
data_dam_5 = DataDam(
    DataSquareSurfaces=cull_pattern_10,
    DataEllipticalSurfaces=cull_pattern_11,
    DataSquareBoundary=curve_8,
    DataEllipticalBoundary=ellipse.Ellipse,
    BufferDelay=10000000,
    BufferMode=0)  # -> DataSquareSurfaces, DataEllipticalSurfaces, DataSquareBoundary, DataEllipticalBoundary

entwine_2 = Entwine(Branch00=data_dam_5.DataSquareSurfaces, Branch01=data_dam_5.DataEllipticalSurfaces, FlattenInputs=True)  # -> simplify(Result)
entwine_3 = Entwine(Branch00=data_dam_5.DataSquareBoundary, Branch01=data_dam_5.DataEllipticalBoundary, FlattenInputs=True)  # -> simplify(Result)
tree_branch_2 = TreeBranch(Tree=entwine_2, Path=false_rectangle, MaintainPaths=True)
tree_branch_3 = TreeBranch(Tree=entwine_3, Path=false_rectangle, MaintainPaths=True)
flip = Flip(Surface=tree_branch_2)  # -> Surface, Result
group_2 = Group(Objects=tree_branch_2)
bounding_box_2 = BoundingBox(Content=group_2, Plane=PlaneXY(0, 0, 0))  # -> Box, Box_2
geometry = Geometry(flip.Surface)
mirror = Mirror(Geometry=geometry, Plane=plane_normal)  # -> Geometry, Transform
deconstruct_box_6 = DeconstructBox(Box=bounding_box_2.Box)  # -> Plane, X, Y, Z
deconstruct_domain_2 = DeconstructDomain(Domain=deconstruct_box_6.Z)  # -> Start, End
rotate_axis_4 = RotateAxis(Geometry=mirror.Geometry, Angle=radians_9, Axis=move_8.Geometry)  # -> Geometry, Transform
subtraction_8 = Subtraction(A=number_slider_8, B=deconstruct_domain_2.Start)
cluster_4 = Cluster_3(A=number_slider_8, objects=rotate_axis_4.Geometry)
unit_z_13 = UnitZ(Factor=subtraction_8)
move_13 = Move(Geometry=rotate_axis_4.Geometry, Motion=cluster_4)  # -> simplify(flatten(Geometry)), Transform
move_14 = Move(Geometry=geometry, Motion=unit_z_13)  # -> simplify(flatten(Geometry)), Transform
flip_2 = Flip(Surface=move_13.Geometry)  # -> Surface, Result
entwine_4 = Entwine(Branch00=move_14.Geometry, Branch01=flip_2.Surface, FlattenInputs=True)  # -> simplify(Result)
tree_branch_4 = TreeBranch(Tree=entwine_4, Path=false_concave, MaintainPaths=True)

brep_edges_5 = BrepEdges(Brep=tree_branch_4)  # -> Naked, Interior, NonManifold

negative_8 = Negative(Value=number_slider_15)
unit_z_14 = UnitZ(Factor=10000000)
offset_curve_2 = OffsetCurve(Curve=tree_branch_3, Distance=negative_8, Corners=1)
negative_9 = Negative(Value=number_slider_6)
unit_z_15 = UnitZ(Factor=negative_9)
extrude_4 = Extrude(Base=offset_curve_2, Direction=unit_z_14)
cap_holes_2 = CapHoles(Brep=extrude_4)
split_brep = SplitBrep(Brep=tree_branch_4, Cutter=cap_holes_2)
list_item_28 = ListItem(List=split_brep, Index=0, Wrap=True)

brep_edges_6 = BrepEdges(Brep=tree_branch_4)  # -> Naked, Interior, NonManifold
area_14 = Area(Geometry=tree_branch_4)  # -> Area, Centroid
evaluate_surface = EvaluateSurface(Surface=reparameterize(tree_branch_4), Point=md_slider)  # -> Point, Normal, UDirection, VDirection, Frame
join_curves_9 = JoinCurves(Curves=brep_edges_6.Naked, Preserve=False)  # -> flatten(Curves)
plane_origin = PlaneOrigin(Base=evaluate_surface.Frame, Origin=area_14.Centroid)
flip_curve = FlipCurve(Curve=join_curves_9)  # -> Curve, Flag
offset_curve_3 = OffsetCurve(Curve=join_curves_9, Distance=number_slider_13, Plane=plane_origin, Corners=1)  # -> flatten(Curve)
offset_curve_4 = OffsetCurve(Curve=flip_curve.Curve, Distance=number_slider_13, Plane=plane_origin, Corners=1)  # -> flatten(Curve)
deconstruct_plane_2 = DeconstructPlane(Plane=plane_origin)  # -> Origin, XAxis, YAxis, ZAxis
multiplication_9 = Multiplication(A=deconstruct_plane_2.ZAxis, B=number_slider_14)
area_15 = Area(Geometry=offset_curve_3)  # -> Area, Centroid
area_16 = Area(Geometry=offset_curve_4)  # -> Area, Centroid
larger_than_3 = LargerThan(FirstNumber=area_15.Area, SecondNumber=area_16.Area)  # -> LargerThan, OrEqualTo
panel_62 = Panel(larger_than_3.LargerThan)
pick_n_choose = PickNChoose(Pattern=panel_62, Stream0=flatten(offset_curve_3), Stream1=flatten(offset_curve_4))
extrude_5 = Extrude(Base=pick_n_choose, Direction=multiplication_9)

area_17 = Area(Geometry=cull_pattern_9)  # -> Area, Centroid
brep_edges_7 = BrepEdges(Brep=cull_pattern_9)  # -> Naked, Interior, NonManifold
average_2 = Average(Input=area_17.Area)
length = Length(Curve=brep_edges_7.Naked)  # -> flatten(Length)
subtraction_9 = Subtraction(A=area_17.Area, B=average_2)
larger_than_4 = LargerThan(FirstNumber=number_slider_23, SecondNumber=length)  # -> LargerThan, OrEqualTo
list_length_2 = ListLength(List=flatten(plane))
list_length_3 = ListLength(List=subtraction_9)
absolute = Absolute(Value=subtraction_9)
cull_pattern_12 = CullPattern(List=length, CullPattern=larger_than_4.LargerThan)
subtraction_10 = Subtraction(A=list_length_2, B=list_length_3)
absolute_2 = Absolute(Value=subtraction_10)
null_item_2 = NullItem(Item=cull_pattern_12)  # -> NullFlags, InvalidFlags, Description
gate_not_4 = GateNot(A=null_item_2.NullFlags)
multiplication_10 = Multiplication(A=number_slider_23, B=gate_not_4)
mass_addition_9 = MassAddition(Input=absolute)  # -> Result, PartialResults
subtraction_11 = Subtraction(A=multiplication_10, B=cull_pattern_12)
multiplication_11 = Multiplication(A=absolute_2, B=average_2)
square = Square(Value=subtraction_11)
mass_addition_10 = MassAddition(Input=square)  # -> Result, PartialResults
addition_9 = Addition(A=multiplication_11, B=mass_addition_9.Result)
multiplication_12 = Multiplication(A=mass_addition_10.Result, B=Slider(10, range=0..10))
addition_10 = Addition(A=addition_9, B=multiplication_12)
panel_63 = Panel(addition_9)
panel_64 = Panel(addition_10)
galapagos_2 = Galapagos(fitness=addition_10, gene=gene_pool)

brep_edges_8 = BrepEdges(Brep=list_item_28)  # -> simplify(Naked), Interior, NonManifold

curve_12 = Curve(brep_edges_8.Naked)
join_curves_10 = JoinCurves(Curves=curve_12, Preserve=False)
explode_2 = Explode(Curve=join_curves_10, Recursive=True)  # -> Segments, Vertices
end_points_5 = EndPoints(Curve=explode_2.Segments)  # -> Start, End
curve_closest_point_5 = CurveClosestPoint(Point=end_points_5.Start, Curve=explode_2.Segments)  # -> Point, Parameter, Distance
curve_closest_point_6 = CurveClosestPoint(Point=end_points_5.End, Curve=explode_2.Segments)  # -> Point, Parameter, Distance
evaluate_curve = EvaluateCurve(Curve=explode_2.Segments, Parameter=curve_closest_point_5.Parameter)  # -> Point, Tangent, Angle
evaluate_curve_2 = EvaluateCurve(Curve=explode_2.Segments, Parameter=curve_closest_point_6.Parameter)  # -> Point, Tangent, Angle
shift_list_6 = ShiftList(List=evaluate_curve.Point, Shift=1, Wrap=True)
shift_list_7 = ShiftList(List=evaluate_curve.Tangent, Shift=1, Wrap=True)
angle_2 = Angle(VectorA=shift_list_7, VectorB=evaluate_curve_2.Tangent)  # -> Angle, Reflex
larger_than_5 = LargerThan(FirstNumber=angle_2.Angle, SecondNumber="0.01")  # -> LargerThan, OrEqualTo
cull_pattern_13 = CullPattern(List=shift_list_6, CullPattern=larger_than_5.LargerThan)

negative_10 = Negative(Value=Slider(100, range=0..300))
offset_curve_5 = OffsetCurve(Curve=offset_curve_2, Distance=negative_10, Corners=1)

curve_closest_point_7 = CurveClosestPoint(Point=cull_pattern_13, Curve=join_curves_10)  # -> Point, Parameter, Distance
shatter = Shatter(Curve=join_curves_10, Parameters=curve_closest_point_7.Parameter)
end_points_6 = EndPoints(Curve=shatter)  # -> Start, End
length_2 = Length(Curve=shatter)
sort_list_7 = SortList(Keys=length_2, ValuesValuesA=shatter)  # -> Keys, ValuesValuesA
entwine_5 = Entwine(Branch00=" 2", Branch01="3", FlattenInputs=True)  # -> simplify(Result)
tree_branch_5 = TreeBranch(Tree=entwine_5, Path=false_rectangle, MaintainPaths=True)
list_length_4 = ListLength(List=sort_list_7.ValuesValuesA)
list_item_29 = ListItem(List=sort_list_7.ValuesValuesA, Index=" -1", Wrap=True)  # -> simplify(Item)
smaller_than_2 = SmallerThan(FirstNumber=list_length_4, SecondNumber=tree_branch_5)  # -> SmallerThan, simplify(OrEqualTo)
divide_curve_4 = DivideCurve(Curve=list_item_29, Count=Slider(2, range=0..10), Kinks=False)  # -> Points, Tangents, Parameters
panel_65 = Panel("""0
-1""")
gate_not_5 = GateNot(A=smaller_than_2.OrEqualTo)
cull_index_4 = CullIndex(List=divide_curve_4.Parameters, Indices=panel_65, Wrap=True)  # -> simplify(List)
cull_pattern_14 = CullPattern(List=cull_index_4, CullPattern=smaller_than_2.OrEqualTo)
cull_index_5 = CullIndex(List=sort_list_7.ValuesValuesA, Indices=" -1", Wrap=True)  # -> simplify(List)
cull_pattern_15 = CullPattern(List=list_item_29, CullPattern=gate_not_5)  # -> simplify(List)
shatter_2 = Shatter(Curve=list_item_29, Parameters=cull_pattern_14)  # -> simplify(Segments)
curve_13 = Curve([shatter_2, cull_pattern_15, cull_index_5])
end_points_7 = EndPoints(Curve=curve_13)  # -> Start, End

negative_11 = Negative(Value=number_slider_16)
area_18 = Area(Geometry=tree_branch_4)  # -> Area, Centroid
unit_z_16 = UnitZ(Factor=negative_11)
move_15 = Move(Geometry=area_18.Centroid, Motion=unit_z_16)  # -> simplify(graft(Geometry)), Transform
flatten_tree_4 = FlattenTree(Tree=move_15.Geometry, Path="{0}")
line_17 = Line(StartPoint=end_points_7.Start, EndPoint=move_15.Geometry)
flatten_tree_5 = FlattenTree(Tree=move_15.Geometry, Path="{0}")
shift_list_8 = ShiftList(List=flatten_tree_5, Shift=1, Wrap=boolean_toggle)
line_18 = Line(StartPoint=flatten_tree_4, EndPoint=shift_list_8)
curve_14 = Curve(flatten([line_18, line_17]))
move_16 = Move(Geometry=curve_14, Motion=unit_z_15)  # -> flatten(Geometry), Transform
length_3 = Length(Curve=offset_curve_2)
explode_3 = Explode(Curve=flatten(move_16.Geometry), Recursive=True)  # -> flatten(Segments), Vertices
multiplication_13 = Multiplication(A=length_3, B=[number_slider_2, Slider(0.45, range=0..1), Slider(0.963, range=0..1)])
divide_length_2 = DivideLength(Curve=offset_curve_5, Length=multiplication_13)  # -> Points, Tangents, Parameters
cull_duplicates = CullDuplicates(Points=flatten(explode_3.Vertices), Tolerance=0.1, CullMode=3)  # -> Points, Indices, Valence
list_item_30 = ListItem(List=divide_length_2.Points, Index=1, Wrap=True)
project_3 = Project(Geometry=cull_duplicates.Points, Plane=PlaneXY(0, 0, 0))  # -> Geometry, Transform
cull_duplicates_2 = CullDuplicates(Points=list_item_30, Tolerance=0.1, CullMode=3)  # -> Points, Indices, Valence
closest_points = ClosestPoints(Point=cull_duplicates_2.Points, Cloud=project_3.Geometry, Count=Slider(3, range=0..10))  # -> simplify(ClosestPoint), CPIndex, Distance
list_item_31 = ListItem(List=cull_duplicates.Points, Index=closest_points.CPIndex, Wrap=True)
panel_66 = Panel(closest_points.ClosestPoint)
line_19 = Line(StartPoint=graft(cull_duplicates_2.Points), EndPoint=list_item_31)  # -> simplify(Line)

move_17 = Move(Geometry=curve_13, Motion=unit_z_15)  # -> flatten(Geometry), Transform
length_4 = Length(Curve=move_17.Geometry)
division_7 = Division(A=length_4, B=number_slider_9)
integer = Integer(division_7)
number_slider_50 = Slider(200, range=0..1000)
divide_curve_5 = DivideCurve(Curve=move_17.Geometry, Count=integer, Kinks=False)  # -> flatten(Points), Tangents, Parameters
brep_9 = Brep(tree_branch_4)
cull_duplicates_3 = CullDuplicates(Points=divide_curve_5.Points, Tolerance=0.1, CullMode=1)  # -> Points, Indices, Valence
unit_z_17 = UnitZ(Factor=number_slider_50)
division_8 = Division(A=number_slider_50, B=2)
brep_join = BrepJoin(Breps=brep_9)  # -> Breps, Closed
addition_11 = Addition(A=division_8, B=number_slider_6)
unit_z_18 = UnitZ(Factor=addition_11)
move_18 = Move(Geometry=cull_duplicates_3.Points, Motion=unit_z_18)  # -> Geometry, Transform
line_20 = Line(StartPoint=cull_duplicates_3.Points, EndPoint=move_18.Geometry)
unit_z_19 = UnitZ(Factor=Slider(400, range=0..1000))
negative_12 = Negative(Value=number_slider_12)
move_19 = Move(Geometry=cull_duplicates_3.Points, Motion=unit_z_19)  # -> Geometry, Transform
pipe_2 = Pipe(Curve=line_20, Radius=number_slider_10, Caps=" 1")
unit_z_20 = UnitZ(Factor=negative_12)
extrude_6 = Extrude(Base=brep_join.Breps, Direction=unit_z_17)
line_21 = Line(StartPoint=cull_duplicates_3.Points, EndPoint=move_19.Geometry)
pipe_3 = Pipe(Curve=line_21, Radius=number_slider_11, Caps=0)  # -> flatten(Pipe)
split_brep_multiple_2 = SplitBrepMultiple(Brep=brep_join.Breps, Cutters=pipe_3)
cull_index_6 = CullIndex(List=split_brep_multiple_2, Indices=0, Wrap=True)

curve_15 = Curve(move_17.Geometry)
curve_16 = Curve(move_16.Geometry)
curve_17 = Curve([curve_16, curve_15, line_19])
end_points_8 = EndPoints(Curve=curve_17)  # -> Start, End
curve_18 = Curve(curve_17)
cull_duplicates_4 = CullDuplicates(Points=[end_points_8.Start, end_points_8.End], Tolerance=0.1, CullMode=1)  # -> Points, Indices, Valence
negative_13 = Negative(Value=Slider(180, range=0..200))
extend_curve = ExtendCurve(Curve=curve_18, Type=0, Start=negative_13, End=negative_13)
pipe_4 = Pipe(Curve=extend_curve, Radius=number_slider_7, Caps="0")  # -> flatten(Pipe)
pipe_5 = Pipe(Curve=extend_curve, Radius=number_slider_7, Caps="1")  # -> flatten(Pipe)
brep_edges_9 = BrepEdges(Brep=pipe_4)  # -> Naked, Interior, NonManifold
md_slider_4 = MDSlider(SliderMode=0, slider_value=Point(0.5, 0.5, 0.5), x_domain=Domain(0, 1), y_domain=Domain(0, 1), z_domain=Domain(0, 1))
list_item_32 = ListItem(List=brep_edges_9.Naked, Index=1, Wrap=True)  # -> Item, Item1
evaluate_surface_2 = EvaluateSurface(Surface=reparameterize(list_item_32.Item1), Point=md_slider_4)  # -> Point, Normal, UDirection, VDirection, Frame
evaluate_surface_3 = EvaluateSurface(Surface=reparameterize(list_item_32.Item), Point=md_slider_4)  # -> Point, Normal, UDirection, VDirection, Frame
number_slider_51 = Slider(0.3, range=0..1)
negative_14 = Negative(Value=Slider(150, range=0..1000))
deconstruct_plane_3 = DeconstructPlane(Plane=evaluate_surface_3.Frame)  # -> Origin, XAxis, YAxis, ZAxis
deconstruct_plane_4 = DeconstructPlane(Plane=evaluate_surface_2.Frame)  # -> Origin, XAxis, YAxis, ZAxis
scale = Scale(Geometry=list_item_32.Item1, Center=deconstruct_plane_4.Origin, Factor=number_slider_51)  # -> Geometry, Transform
multiplication_14 = Multiplication(A=deconstruct_plane_4.ZAxis, B=negative_14)
scale_2 = Scale(Geometry=list_item_32.Item, Center=deconstruct_plane_3.Origin, Factor=number_slider_51)  # -> Geometry, Transform
multiplication_15 = Multiplication(A=deconstruct_plane_3.ZAxis, B=negative_14)
move_20 = Move(Geometry=scale_2.Geometry, Motion=multiplication_15)  # -> Geometry, Transform
move_21 = Move(Geometry=scale.Geometry, Motion=multiplication_14)  # -> Geometry, Transform
ruled_surface = RuledSurface(CurveA=list_item_32.Item, CurveB=move_20.Geometry)
extrude_7 = Extrude(Base=cull_index_6, Direction=unit_z_20)
sphere = Sphere(Base=cull_duplicates_4.Points, Radius=Slider(70, range=0..100))
ruled_surface_2 = RuledSurface(CurveA=list_item_32.Item1, CurveB=move_21.Geometry)
cap_holes_3 = CapHoles(Brep=extrude_5)
brep_10 = Brep(pipe_5)

solid_difference_2 = SolidDifference(BrepsA=pipe_2, BrepsB=extrude_6)
cap_holes_4 = CapHoles(Brep=ruled_surface)

custom_preview_4 = CustomPreview(
    Geometry=[extrude_7, sphere, brep_10, ruled_surface_2, ruled_surface],
    Material=ColourSwatch(SwatchColor=RGB(163, 163, 163)))
custom_preview_5 = CustomPreview(Geometry=cap_holes_3, Material=ColourSwatch(SwatchColor=RGB(138, 219, 190)))

shape = Curve(tree_branch_3)

offset_curve_6 = OffsetCurve(Curve=shape, Distance=Slider(100, range=0..100), Corners=1)

curve_curve_2 = CurveCurve(CurveA=offset_curve_6, CurveB=join_curves_2)  # -> Points, flatten(ParamsA), ParamsB
shatter_3 = Shatter(Curve=offset_curve_6, Parameters=curve_curve_2.ParamsA)  # -> flatten(Segments)
curve_middle_2 = CurveMiddle(Curve=shatter_3)
point_in_curve_7 = PointInCurve(Point=curve_middle_2, Curve=join_curves_2)  # -> Relationship, Point
boolean_2 = Boolean(point_in_curve_7.Relationship)
gate_not_6 = GateNot(A=boolean_2)
cull_pattern_16 = CullPattern(List=shatter_3, CullPattern=gate_not_6)  # -> simplify(List)

curve_19 = Curve(cull_pattern_16)

curve_curve_3 = CurveCurve(CurveA=cull_pattern_16, CurveB=brep_edges_4.Naked)  # -> Points, flatten(ParamsA), ParamsB
shatter_4 = Shatter(Curve=cull_pattern_16, Parameters=curve_curve_3.ParamsA)  # -> flatten(Segments)

null_item_3 = NullItem(Item=curve_curve_3.ParamsA)  # -> NullFlags, InvalidFlags, Description
mass_addition_11 = MassAddition(Input=null_item_3.NullFlags)  # -> Result, PartialResults
entwine_6 = Entwine(Branch00=shatter_4, Branch01=curve_19, FlattenInputs=True)  # -> simplify(Result)
tree_branch_6 = TreeBranch(Tree=entwine_6, Path=mass_addition_11.Result, MaintainPaths=True)

curve_middle_3 = CurveMiddle(Curve=tree_branch_6)
point_in_curve_8 = PointInCurve(Point=curve_middle_3, Curve=join_curves_8)  # -> Relationship, Point
boolean_3 = Boolean(point_in_curve_8.Relationship)
cull_pattern_17 = CullPattern(List=tree_branch_6, CullPattern=boolean_3)  # -> simplify(List)

length_5 = Length(Curve=cull_pattern_17)
smaller_than_3 = SmallerThan(FirstNumber=number_slider, SecondNumber=length_5)  # -> SmallerThan, OrEqualTo
cull_pattern_18 = CullPattern(List=cull_pattern_17, CullPattern=smaller_than_3.SmallerThan)
path_mapper_2 = PathMapper(cull_pattern_18, source=["{0;0;0;0;0;A}", "{A}"], target=["{A}", "{A}"])

curve_curve_4 = CurveCurve(CurveA=simplify(path_mapper_2), CurveB=simplify(join_curves_5))  # -> Points, ParamsA, ParamsB
path_mapper_3 = PathMapper(curve_curve_4.ParamsA, source="{A;B}", target="{A}")
shatter_5 = Shatter(Curve=cull_pattern_18, Parameters=path_mapper_3)  # -> flatten(Segments)

null_item_4 = NullItem(Item=path_mapper_3)  # -> NullFlags, InvalidFlags, Description
panel_67 = Panel(curve_curve_4.ParamsA)
cull_pattern_19 = CullPattern(List=cull_pattern_18, CullPattern=null_item_4.NullFlags)  # -> flatten(List)
curve_20 = Curve([cull_pattern_19, shatter_5])

curve_middle_4 = CurveMiddle(Curve=flatten(curve_20))  # -> simplify(flatten(Midpoint))
point_in_curve_9 = PointInCurve(Point=curve_middle_4, Curve=curve_11)  # -> Relationship, Point
flip_matrix_2 = FlipMatrix(Data=point_in_curve_9.Relationship)
mass_addition_12 = MassAddition(Input=flip_matrix_2)  # -> Result, PartialResults
boolean_4 = Boolean(flatten(mass_addition_12.Result))
gate_not_7 = GateNot(A=boolean_4)
cull_pattern_20 = CullPattern(List=curve_20, CullPattern=gate_not_7)
cull_pattern_21 = CullPattern(List=curve_20, CullPattern=boolean_4)
extrude_8 = Extrude(Base=cull_pattern_20, Direction=unit_z_4)
extrude_9 = Extrude(Base=cull_pattern_21, Direction=unit_z_4)
custom_preview_6 = CustomPreview(Geometry=extrude_9, Material=ColourSwatch(SwatchColor=RGB(154, 214, 204)))
custom_preview_7 = CustomPreview(Geometry=extrude_8, Material=ColourSwatch(SwatchColor=RGB(255, 255, 255)))

deconstruct_brep_4 = DeconstructBrep(Brep=extrude_9)  # -> Faces, Edges, Vertices; disabled
quad_panels = QuadPanels(Surface=extrude_9, UDivisions=number_slider_29, VDivisions=number_slider_28)  # disabled
project_4 = Project(Curve=quad_panels, Brep=extrude_9, Direction=Vector(0, 0, 1))  # disabled
pipe_6 = Pipe(Curve=[deconstruct_brep_4.Edges, project_4], Radius=number_slider_30, Caps=0)  # disabled
custom_preview_8 = CustomPreview(Geometry=pipe_6, Material=colour_swatch)  # disabled

explode_4 = Explode(Curve=cull_pattern_21, Recursive=True)  # -> Segments, Vertices
brep_edges_10 = BrepEdges(Brep=extrude_8)  # -> Naked, Interior, NonManifold
brep_edges_11 = BrepEdges(Brep=extrude_9)  # -> Naked, Interior, NonManifold

length_6 = Length(Curve=explode_4.Segments)
length_7 = Length(Curve=cull_pattern_20)
division_9 = Division(A=length_7, B=number_slider_32)
division_10 = Division(A=length_6, B=number_slider_32)
divide_curve_6 = DivideCurve(Curve=cull_pattern_20, Count=division_9, Kinks=False)  # -> Points, Tangents, Parameters
divide_curve_7 = DivideCurve(Curve=explode_4.Segments, Count=division_10, Kinks=False)  # -> Points, Tangents, Parameters
move_22 = Move(Geometry=divide_curve_7.Points, Motion=unit_z_4)  # -> Geometry, Transform
move_23 = Move(Geometry=divide_curve_6.Points, Motion=unit_z_4)  # -> Geometry, Transform
line_22 = Line(StartPoint=move_22.Geometry, EndPoint=divide_curve_7.Points)
line_23 = Line(StartPoint=divide_curve_6.Points, EndPoint=move_23.Geometry)

cluster_5 = Cluster(curve=flatten([brep_edges_11.Naked, brep_edges_11.Interior, brep_edges_10.Naked, brep_edges_10.Interior, line_22, line_23]))
end_points_9 = EndPoints(Curve=cluster_5)  # -> Start, End
cull_duplicates_5 = CullDuplicates(Points=[end_points_9.Start, end_points_9.End], Tolerance=0.1, CullMode=3)  # -> Points, Indices, Valence
pipe_7 = Pipe(Curve=cluster_5, Radius=number_slider_39, Caps=0)  # -> flatten(Pipe)
sphere_2 = Sphere(Base=cull_duplicates_5.Points, Radius=number_slider_39)
brep_11 = Brep([pipe_7, extrude_8])

brep_12 = Brep([extrude_7, sphere, brep_10, ruled_surface_2, ruled_surface, cap_holes_3, brep_11])
brep_13 = Brep(brep_12)

mesh_brep_4 = MeshBrep(
    Brep=brep_13,
    Settings={GridMaxCount=0, GridMinCount=16, JaggedSeams=False, MaxEdgeLength=0, MinEdgeLength=0.0001, MinTolerance=0, Refine=True, RefineAngle=0, RelativeTolerance=0.65, SimplePlanes=True, Tolerance=0})
geometry_2 = Geometry(mesh_brep_4)
c_script = CSharpScript(geometries=geometry_2, filename=concatenate_2, directory=file_path, export=boolean_toggle_2)  # -> out; inputs geometries: tree of GeometryBase, filename: String, directory: String, export: Boolean
# ---------- c_script: C# usings ----------
using System.IO;
# ---------- c_script: C# ----------
    if(export){
      List<Guid> guids = new List<Guid>();
      for(int i = 0; i < geometries.BranchCount; i++){
        for(int n = 0; n < geometries.Branches[i].Count; n++){
          var geom = geometries.Branches[i][n];
          var guid = Rhino.RhinoDoc.ActiveDoc.Objects.Add(geom);
          guids.Add(guid);
        }
      }

      Rhino.RhinoDoc.ActiveDoc.Objects.Select(guids);

      string filepath = Path.Combine(directory, filename);
      string cmd = "_-Export " + "\"" + filepath + "\"" + " _Enter _Enter";

      Rhino.RhinoApp.RunScript(cmd, false);

      Rhino.RhinoDoc.ActiveDoc.Objects.Delete(guids, true);
    }
# ---------- end c_script ----------

group_3 = Group(Objects=[pipe_7, sphere_2])

mesh_brep_5 = MeshBrep(Brep=brep_11, Settings=settings_quality)  # disabled
createbfgeometry = Butterfly_CreateButterflyGeometry(
    name=panel_49,
    geo=flatten(mesh_brep_5),
    boundary=wall,
    refine_levels=panel_48,
    n_srf_layers=panel_50,
    mesh_set=settings_quality_2)  # -> out, BF_geo; disabled; plug-in component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
createcasefromtunnel = Butterfly_CreateCaseFromTunnel(
    name=panel_51,
    BF_geo=flatten(createbfgeometry.BF_geo),
    wind_vector=windvector,
    ref_wind_height=10,
    landscape=6,
    tunnel_params=tunnelparams.tunnel_params,
    run=boolean_toggle_5)  # -> out, block_pts, wind_tunnel, case; disabled; plug-in component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
blockmesh = Butterfly_blockMesh(case=createcasefromtunnel.case, overwrite=True, write=boolean_toggle_6, run=boolean_toggle_7)  # -> out, case; disabled; plug-in component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
panel_68 = Panel(createcasefromtunnel.out)  # disabled
loadmesh = Butterfly_LoadMesh(case=blockmesh.case, inner_mesh=boolean_toggle_8, load=boolean_toggle_8)  # -> mesh; disabled; plug-in component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
panel_69 = Panel(blockmesh.out)  # disabled
snappyhexmesh = Butterfly_snappyHexMesh(case=blockmesh.case, glob_refine_level=panel_53, write=boolean_toggle_9, run=boolean_toggle_10)  # -> out, case; disabled; plug-in component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
loadmesh_2 = Butterfly_LoadMesh(case=snappyhexmesh.case, inner_mesh=boolean_toggle_11, load=boolean_toggle_11)  # -> mesh; disabled; plug-in component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
solution = Butterfly_Solution(
    case=snappyhexmesh.case,
    recipe=steadyincomp.recipe,
    solution_par=solutionparams,
    interval=2,
    write=boolean_toggle_12,
    run=boolean_toggle_12)  # -> out, solution, is_running, timestep, residual_fields, residual_values, log_files; disabled; plug-in component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
loadprobesvalue = Butterfly_LoadProbesValue(solution=solution.solution, field=panel_55)  # -> values; disabled; plug-in component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
vector_2 = Vector(loadprobesvalue)  # disabled
panel_70 = Panel(solution.out)  # disabled
multiplication_16 = Multiplication(A=vector_2, B=number_slider_48)  # disabled
vector_display_ex = VectorDisplayEx(Point=point_16, Vector=multiplication_16, Colour=RGB(0, 0, 0), Width=2)  # disabled

curve_21 = Curve(line_19)
curve_22 = Curve([curve_15, curve_16])
curve_23 = Curve(brep_edges_11.Naked)
curve_24 = Curve(line_23)
curve_25 = Curve(line_22)
curve_26 = Curve(brep_edges_11.Interior)

# ---- group: Curve
curve_27 = Curve(brep_edges_10.Naked)

# ----
pipe_8 = Pipe(Curve=[curve_22, curve_21, curve_23, curve_27, curve_24, curve_25, curve_26], Radius=diameter, Caps=0)
multiplication_17 = Multiplication(A=thickness, B=2)
length_8 = Length(Curve=flatten([curve_26, curve_25, curve_24, curve_27, curve_23, curve_21, curve_22]))
subtraction_12 = Subtraction(A=diameter, B=multiplication_17)
null_item_5 = NullItem(Item=length_8)  # -> NullFlags, InvalidFlags, Description
division_11 = Division(A=diameter, B=2)
division_12 = Division(A=subtraction_12, B=2)
dispatch_9 = Dispatch(List=length_8, DispatchPattern=null_item_5.NullFlags)  # -> ListA, ListB
division_13 = Division(A=division_11, B=1000)
division_14 = Division(A=division_12, B=1000)
expression_2 = Expression(r_out=division_13, r_in=division_14, Expression="(3.14*r_out²)-(3.14*r_in²)")
mass_addition_13 = MassAddition(Input=dispatch_9.ListB)  # -> Result, PartialResults
division_15 = Division(A=mass_addition_13.Result, B=1000)
multiplication_18 = Multiplication(A=expression_2, B=division_15)
density_aluminium = Slider(2710, range=0..10000)
density_steel = Slider(7850, range=0..10000)
multiplication_19 = Multiplication(A=density_aluminium, B=multiplication_18)
multiplication_20 = Multiplication(A=multiplication_18, B=density_steel)
round_4 = Round(Number=multiplication_19)  # -> Nearest, Floor, Ceiling
round_5 = Round(Number=multiplication_20)  # -> Nearest, Floor, Ceiling
boolean_toggle_13 = BooleanToggle(False)
kg_aluminium = Panel(round_4.Nearest)
kg_steel = Panel(round_5.Nearest)
stream_filter_3 = StreamFilter(Gate=boolean_toggle_13, Stream0=kg_steel, Stream1=kg_aluminium)
stream_filter_4 = StreamFilter(Gate=boolean_toggle_13, Stream0="4", Stream1="4")
stream_filter_5 = StreamFilter(Gate=boolean_toggle_13, Stream0="3", Stream1="4")
stream_filter_6 = StreamFilter(Gate=boolean_toggle_13, Stream0="-0.6", Stream1="-2.7")
stream_filter_7 = StreamFilter(Gate=boolean_toggle_13, Stream0="-1.2", Stream1="-1.7")
stream_filter_8 = StreamFilter(Gate=boolean_toggle_13, Stream0="-2.3", Stream1="-13.3")
stream_filter_9 = StreamFilter(Gate=boolean_toggle_13, Stream0="-8.1", Stream1="-34.1")
stream_filter_10 = StreamFilter(Gate=boolean_toggle_13, Stream0="-16.5", Stream1="-22.8")
stream_filter_11 = StreamFilter(Gate=boolean_toggle_13, Stream0="-30.8", Stream1="-200.0")
stream_filter_12 = StreamFilter(Gate=boolean_toggle_13, Stream0="42.0%", Stream1="45.1%")
stream_filter_13 = StreamFilter(Gate=boolean_toggle_13, Stream0="no", Stream1="no")
stream_filter_14 = StreamFilter(Gate=boolean_toggle_13, Stream0="0.61", Stream1="1.67")
footprint_end_of_life_kg_co2_kg = Panel(stream_filter_6)
footprint_processing_kg_co2_kg = Panel(stream_filter_7)
footprint_production_kg_co2_kg = Panel(stream_filter_8)
end_of_life_energy_mj_kg = Panel(stream_filter_9)
processing_energy_mj_kg = Panel(stream_filter_10)
embodied_energy_mj_kg = Panel(stream_filter_11)
costs = Panel(stream_filter_14)
multiplication_21 = Multiplication(A=footprint_end_of_life_kg_co2_kg, B=stream_filter_3)
multiplication_22 = Multiplication(A=footprint_processing_kg_co2_kg, B=stream_filter_3)
multiplication_23 = Multiplication(A=footprint_production_kg_co2_kg, B=stream_filter_3)
multiplication_24 = Multiplication(A=end_of_life_energy_mj_kg, B=stream_filter_3)
multiplication_25 = Multiplication(A=processing_energy_mj_kg, B=stream_filter_3)
multiplication_26 = Multiplication(A=embodied_energy_mj_kg, B=stream_filter_3)
multiplication_27 = Multiplication(A=costs, B=stream_filter_3)
round_6 = Round(Number=multiplication_21)  # -> Nearest, Floor, Ceiling
round_7 = Round(Number=multiplication_22)  # -> Nearest, Floor, Ceiling
round_8 = Round(Number=multiplication_23)  # -> Nearest, Floor, Ceiling
round_9 = Round(Number=multiplication_24)  # -> Nearest, Floor, Ceiling
round_10 = Round(Number=multiplication_25)  # -> Nearest, Floor, Ceiling
round_11 = Round(Number=multiplication_26)  # -> Nearest, Floor, Ceiling
round_12 = Round(Number=multiplication_27)  # -> Nearest, Floor, Ceiling
footprint_processing_kg_co2 = Panel(round_7.Nearest)
processing_energy_mj = Panel(round_10.Nearest)
footprint_end_of_life_kg_co2 = Panel(round_6.Nearest)
footprint_production_kg_co2 = Panel(round_8.Nearest)
end_of_life_energy_mj = Panel(round_9.Nearest)
embodied_energy_mj = Panel(round_11.Nearest)
addition_12 = Addition(A=footprint_end_of_life_kg_co2, B=footprint_processing_kg_co2, C=footprint_production_kg_co2)
addition_13 = Addition(A=end_of_life_energy_mj, B=processing_energy_mj, C=embodied_energy_mj)
total_footprint_kg_co2 = Panel(addition_12)
biodegradable = Panel(stream_filter_13)
total_energy_mj = Panel(addition_13)
durability_uv_1_4 = Panel(stream_filter_4)
durability_water_1_4 = Panel(stream_filter_5)
recycle_current_suply = Panel(stream_filter_12)
renewable = Panel(stream_filter_13)
costs_2 = Panel(round_12.Nearest)
concatenate_3 = Concatenate(FragmentA=flatten(["Total mass structure (kg):", stream_filter_3]))
concatenate_4 = Concatenate(FragmentA=flatten(["Total footprint (kg CO2):", total_footprint_kg_co2]))
concatenate_5 = Concatenate(FragmentA=flatten(["Total energy (MJ):", total_energy_mj]))
concatenate_6 = Concatenate(FragmentA=flatten(["Durability UV (1-4):", durability_uv_1_4]))
concatenate_7 = Concatenate(FragmentA=flatten(["Durability water (1-4):", durability_water_1_4]))
concatenate_8 = Concatenate(FragmentA=flatten(["Recycle % current suply:", recycle_current_suply]))
concatenate_9 = Concatenate(FragmentA=flatten(["Biodegradable:", biodegradable]))
concatenate_10 = Concatenate(FragmentA=flatten(["Renewable:", renewable]))
concatenate_11 = Concatenate(FragmentA=flatten(["Costs (€):", costs_2]))
entwine_7 = Entwine(
    Branch00=concatenate_3,
    Branch01=concatenate_4,
    Branch02=concatenate_5,
    Branch03=concatenate_6,
    Branch04=concatenate_7,
    Branch05=concatenate_8,
    Branch06=concatenate_9,
    Branch07=concatenate_10,
    Branch08=concatenate_11,
    FlattenInputs=True)
environmental_analysis_steel_structure = Panel(entwine_7)

# ---- group: Geometry
stck = Group(Objects=[cap_holes_4, ruled_surface_2, brep_10, extrude_7, solid_difference_2, group_3, sphere])

# ----
cull_index_7 = CullIndex(List=divide_curve_6.Points, Indices=[0, -1], Wrap=True)
cull_index_8 = CullIndex(List=divide_curve_7.Points, Indices=[0, -1], Wrap=True)
move_24 = Move(Geometry=cull_index_7, Motion=unit_z_4)  # -> Geometry, Transform
move_25 = Move(Geometry=cull_index_8, Motion=unit_z_4)  # -> Geometry, Transform
line_24 = Line(StartPoint=cull_index_7, EndPoint=move_24.Geometry)
line_25 = Line(StartPoint=cull_index_8, EndPoint=move_25.Geometry)
deconstruct_brep_5 = DeconstructBrep(Brep=extrude_9)  # -> Faces, Edges, Vertices
deconstruct_brep_6 = DeconstructBrep(Brep=extrude_8)  # -> Faces, Edges, Vertices
surface_split = SurfaceSplit(Surface=deconstruct_brep_5.Faces, Curves=flatten(line_25))
surface_split_2 = SurfaceSplit(Surface=deconstruct_brep_6.Faces, Curves=flatten(line_24))
brep_edges_12 = BrepEdges(Brep=surface_split)  # -> Naked, Interior, NonManifold; disabled
brep_edges_13 = BrepEdges(Brep=surface_split_2)  # -> Naked, Interior, NonManifold; disabled
join_curves_11 = JoinCurves(Curves=brep_edges_12.Naked, Preserve=False)  # -> simplify(Curves); disabled
join_curves_12 = JoinCurves(Curves=brep_edges_13.Naked, Preserve=False)  # -> simplify(Curves); disabled
offset_on_srf = OffsetOnSrf(Curve=flatten(join_curves_11), Distance=number_slider_33, Surface=simplify(flatten(surface_split)))  # disabled
offset_on_srf_2 = OffsetOnSrf(Curve=flatten(join_curves_12), Distance=number_slider_34, Surface=simplify(flatten(surface_split_2)))  # disabled
cap_holes_5 = CapHoles(Brep=pipe_7)  # disabled

# ---- group: Geometry (continued)
panel_71 = Group(Objects=surface_split_2)
transparant = Group(Objects=[surface_split, cap_holes_3])

# ----
bounding_box_3 = BoundingBox(Content=offset_on_srf_2, Plane=PlaneXY(0, 0, 0))  # -> Box, Box_2; disabled
project_5 = Project(Geometry=offset_on_srf_2, Plane=PlaneXY(0, 0, 0))  # -> Geometry, Transform; disabled
deconstruct_box_7 = DeconstructBox(Box=bounding_box_3.Box)  # -> Plane, X, Y, Z; disabled
explode_5 = Explode(Curve=project_5.Geometry, Recursive=True)  # -> Segments, Vertices; disabled
deconstruct_domain_3 = DeconstructDomain(Domain=deconstruct_box_7.Z)  # -> Start, End; disabled
cluster_6 = Cluster(curve=explode_5.Segments)  # disabled
unit_z_21 = UnitZ(Factor=deconstruct_domain_3.Start)  # disabled
join_curves_13 = JoinCurves(Curves=cluster_6, Preserve=False)  # disabled
subtraction_13 = Subtraction(A=deconstruct_domain_3.End, B=deconstruct_domain_3.Start)  # disabled
move_26 = Move(Geometry=join_curves_13, Motion=flatten(unit_z_21))  # -> Geometry, Transform; disabled
unit_z_22 = UnitZ(Factor=flatten(subtraction_13))  # disabled
extrude_10 = Extrude(Base=move_26.Geometry, Direction=unit_z_22)  # disabled

bounding_box_4 = BoundingBox(Content=offset_on_srf, Plane=PlaneXY(0, 0, 0))  # -> Box, Box_2; disabled
project_6 = Project(Geometry=offset_on_srf, Plane=PlaneXY(0, 0, 0))  # -> Geometry, Transform; disabled
explode_6 = Explode(Curve=project_6.Geometry, Recursive=True)  # -> Segments, Vertices; disabled
deconstruct_box_8 = DeconstructBox(Box=bounding_box_4.Box)  # -> Plane, X, Y, Z; disabled
deconstruct_domain_4 = DeconstructDomain(Domain=deconstruct_box_8.Z)  # -> Start, End; disabled
cluster_7 = Cluster(curve=explode_6.Segments)  # disabled
unit_z_23 = UnitZ(Factor=deconstruct_domain_4.Start)  # -> flatten(UnitVector); disabled
join_curves_14 = JoinCurves(Curves=cluster_7, Preserve=False)  # disabled
subtraction_14 = Subtraction(A=deconstruct_domain_4.End, B=deconstruct_domain_4.Start)  # disabled
unit_z_24 = UnitZ(Factor=subtraction_14)  # -> flatten(UnitVector); disabled
move_27 = Move(Geometry=join_curves_14, Motion=unit_z_23)  # -> Geometry, Transform; disabled
extrude_11 = Extrude(Base=move_27.Geometry, Direction=unit_z_24)  # disabled

flip_3 = Flip(Surface=extrude_10)  # -> Surface, Result; disabled
flip_4 = Flip(Surface=extrude_11)  # -> Surface, Result; disabled
evaluate_surface_4 = EvaluateSurface(Surface=reparameterize(extrude_10), Point=md_slider_2)  # -> Point, Normal, UDirection, VDirection, Frame; disabled
evaluate_surface_5 = EvaluateSurface(Surface=reparameterize(flip_4.Surface), Point=md_slider_3)  # -> Point, Normal, UDirection, VDirection, Frame; disabled
multiplication_28 = Multiplication(A=evaluate_surface_4.Normal, B=number_slider_36)  # disabled
multiplication_29 = Multiplication(A=evaluate_surface_4.Normal, B=number_slider_35)  # disabled
panel_72 = Panel(multiplication_29)  # disabled
multiplication_30 = Multiplication(A=evaluate_surface_5.Normal, B=number_slider_37)  # disabled
multiplication_31 = Multiplication(A=evaluate_surface_5.Normal, B=number_slider_38)  # disabled
extrude_12 = Extrude(Base=flatten(extrude_11), Direction=flatten(multiplication_31))  # disabled
solid_difference_3 = SolidDifference(BrepsA=cap_holes_5, BrepsB=flatten(extrude_12))  # disabled
extrude_13 = Extrude(Base=flatten(extrude_10), Direction=flatten(multiplication_28))  # disabled
extrude_14 = Extrude(Base=flatten(extrude_11), Direction=flatten(multiplication_30))  # disabled

mesh_brep_6 = MeshBrep(
    Brep=data,
    Settings={GridMaxCount=0, GridMinCount=16, JaggedSeams=False, MaxEdgeLength=0, MinEdgeLength=0.0001, MinTolerance=0, Refine=True, RefineAngle=0, RelativeTolerance=0.65, SimplePlanes=True, Tolerance=0})  # -> graft(Mesh)
point_17 = Point(deconstruct_box_4.Plane)

sunpath_3 = LBSunPath(location=importepw_2.location, hoys=data_dam_3, center_pt=point_17, scale=number_slider_49)  # -> out, vectors, altitudes, azimuths, hoys, sun_pts, analemma, daily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; plug-in component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

reverse_2 = Reverse(Vector=sunpath_3.vectors)
mesh_ray_3 = MeshRay(Mesh=mesh_brep_6, Point=point_17, Direction=reverse_2)  # -> Point, simplify(Hit)
flip_matrix_3 = FlipMatrix(Data=mesh_ray_3.Hit)
mass_addition_14 = MassAddition(Input=flip_matrix_3)  # -> flatten(Result), PartialResults
gate_not_8 = GateNot(A=mass_addition_14.Result)
cull_pattern_22 = CullPattern(List=sunpath_3.hoys, CullPattern=gate_not_8)

construct_domain_7 = ConstructDomain(DomainStart=Slider(1, range=1..12), DomainEnd=Slider(12, range=1..12))
construct_domain_8 = ConstructDomain(DomainStart=Slider(1, range=1..12), DomainEnd=Slider(12, range=1..12))
construct_domain_9 = ConstructDomain(DomainStart=Slider(0, range=0..23), DomainEnd=Slider(23, range=0..23))
construct_domain_10 = ConstructDomain(DomainStart=Slider(1, range=1..31), DomainEnd=Slider(31, range=1..31))
datetime = LBHOYToDateTime(hoy=cull_pattern_22)  # -> month, day, hour, minute, date; plug-in component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
includes = Includes(Value=datetime.month, Domain=construct_domain_7)  # -> simplify(Includes), Deviation
includes_2 = Includes(Value=datetime.month, Domain=construct_domain_8)  # -> simplify(Includes), Deviation
includes_3 = Includes(Value=datetime.hour, Domain=construct_domain_9)  # -> simplify(Includes), Deviation
includes_4 = Includes(Value=datetime.day, Domain=construct_domain_10)  # -> simplify(Includes), Deviation
gate_or = GateOr(A=includes.Includes, B=includes_2.Includes)
gate_and = GateAnd(A=gate_or, B=includes_4.Includes)
gate_and_2 = GateAnd(A=gate_and, B=includes_3.Includes)
data_dam_6 = DataDam(DataDataA=gate_and_2, BufferDelay=10000000, BufferMode=0)
cull_pattern_23 = CullPattern(List=cull_pattern_22, CullPattern=data_dam_6)

sunpath_4 = LBSunPath(location=importepw_2.location, hoys=cull_pattern_23, center_pt=point_17, scale=number_slider_49)  # -> out, vectors, altitudes, azimuths, hoys, sun_pts, analemma, daily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; plug-in component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

mass_addition_15 = MassAddition(Input=sunpath_4.vectors)  # -> Result, PartialResults
unit_vector_2 = UnitVector(Vector=mass_addition_15.Result)
skymatrix_2 = LBCumulativeSkyMatrix(
    location=importepw_2.location,
    direct_rad=importepw_2.direct_normal_rad,
    diffuse_rad=importepw_2.diffuse_horizontal_rad,
    hoys=sunpath_4.hoys,
    high_density=Toggle(False))  # -> out, sky_mtx; plug-in component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
panel_73 = Panel(unit_vector_2)
skydome_2 = LBSkyDome(sky_mtx=skymatrix_2.sky_mtx, center_pt=point_5, show_comp=boolean_toggle_4)  # -> out, mesh, compass, legend, title, patch_vecs, patch_values, mesh_values, vis_set; plug-in component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
panel_74 = Panel(skymatrix_2.sky_mtx)
deconstruct_vector = DeconstructVector(Vector=panel_73)  # -> XComponent, YComponent, ZComponent

# ---- group: Watch out big calculation
data_dam_7 = DataDam(DataDataA=skydome_2.mesh, BufferDelay=10000000, BufferMode=0)

# ----
skymatrix_3 = LBCumulativeSkyMatrix(
    location=importepw_2.location,
    direct_rad=importepw_2.direct_normal_rad,
    diffuse_rad=importepw_2.diffuse_horizontal_rad,
    hoys=cull_pattern_23)  # -> out, sky_mtx; plug-in component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
angle_3 = Slider(30, range=0..320)
azimuth = Slider(200, range=0..360)
incidentradiation = LBIncidentRadiation(sky_mtx=skymatrix_3.sky_mtx, context=flatten(mesh_brep_6), grid_size="4000", offset_dist="100", run=Toggle(False))  # -> out, points, results, total, mesh, legend, title, int_mtx; plug-in component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
incidentradiation_2 = LBIncidentRadiation(sky_mtx=skymatrix_3.sky_mtx, context=flatten(mesh_brep), grid_size="4000", offset_dist="100", run=Toggle(True))  # -> out, points, results, total, mesh, legend, title, int_mtx; plug-in component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
dirsolar = LBDirectionalSolarIrradiance(
    location=importepw_2.location,
    direct_norm=importepw_2.direct_normal_rad,
    diffuse_horiz=importepw_2.diffuse_horizontal_rad,
    srf_azimuth=azimuth,
    srf_altitude=angle_3)  # -> out, total, direct, diff, reflect; plug-in component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
average_3 = Average(Input=incidentradiation.total)
average_4 = Average(Input=incidentradiation_2.total)
panel_75 = Panel(average_3)
panel_76 = Panel(average_4)

list_length_5 = ListLength(List=cull_pattern_23)
multiplication_32 = Multiplication(A=list_length_5, B=reduction_factor)
random_reduce = RandomReduce(List=cull_pattern_23, Reduction=multiplication_32, Seed=1)

# ---- group: Sunpath preview
sunpath_5 = LBSunPath(location=importepw_2.location, hoys=random_reduce, center_pt=point_5, scale=1)  # -> out, vectors, altitudes, azimuths, hoys, sun_pts, analemma, daily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; plug-in component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

# ----
reverse_3 = Reverse(Vector=sunpath_5.vectors)

list_length_6 = ListLength(List=reverse_3)
panel_77 = Panel(list_length_6)

mesh = Mesh(data_dam_7)
deconstruct_mesh = DeconstructMesh(Mesh=mesh)  # -> Vertices, Faces, Colours, Normals
deconstruct_face = DeconstructFace(Face=deconstruct_mesh.Faces)  # -> CornerA, CornerB, CornerC, CornerD
list_item_33 = ListItem(List=deconstruct_mesh.Vertices, Index=deconstruct_face.CornerA, Wrap=True)
list_item_34 = ListItem(List=deconstruct_mesh.Vertices, Index=deconstruct_face.CornerB, Wrap=True)
list_item_35 = ListItem(List=deconstruct_mesh.Vertices, Index=deconstruct_face.CornerC, Wrap=True)
list_item_36 = ListItem(List=deconstruct_mesh.Vertices, Index=deconstruct_face.CornerD, Wrap=True)
_4point_surface = _4PointSurface(CornerA=list_item_33, CornerB=list_item_34, CornerC=list_item_35, CornerD=list_item_36)
mesh_surface = MeshSurface(Surface=_4point_surface, UCount=number_slider_31, VCount=number_slider_31, Overhang=True, Equalize=False)
face_normals = FaceNormals(Mesh=mesh_surface)  # -> flatten(Centers), Normals
scale_3 = Scale(Geometry=mesh_surface, Center=face_normals.Centers, Factor=Slider(2, range=0..10))  # -> Geometry, Transform

addition_14 = Addition(A=simplify(graft(reverse_3)), B=simplify(cull_pattern_5))  # -> simplify(flatten(Result))
list_length_7 = ListLength(List=flatten(scale_3.Geometry))
list_length_8 = ListLength(List=addition_14)
multiplication_33 = Multiplication(A=list_length_7, B=list_length_8)
panel_78 = Panel(list_length_7)
panel_79 = Panel(list_length_8)

# ---- group: Watch out big calculation
data_dam_8 = DataDam(DataB=scale_3.Geometry, DataA=point_12, DataDataA=addition_14, BufferDelay=10000000, BufferMode=0)  # -> DataB, DataA, DataDataA

# ---- group: Colission preview
mesh_ray_4 = MeshRay(Mesh=graft(data_dam_8.DataB), Point=data_dam_8.DataA, Direction=simplify(data_dam_8.DataDataA))  # -> Point, simplify(Hit)

# ----
mass_addition_16 = MassAddition(Input=mesh_ray_4.Hit)  # -> Result, PartialResults
flatten_tree_6 = FlattenTree(Tree=mass_addition_16.Result, Path="{0}")
data_11 = Data(flatten_tree_6)
larger_than_6 = LargerThan(FirstNumber=data_11, SecondNumber=Slider(20, range=0..20))  # -> LargerThan, OrEqualTo
gate_not_9 = GateNot(A=larger_than_6.LargerThan)
cull_pattern_24 = CullPattern(List=mesh_surface, CullPattern=larger_than_6.LargerThan)
face_normals_2 = FaceNormals(Mesh=cull_pattern_24)  # -> Centers, Normals

# ---- group: Make sure this is approximately 5 milion by changing the reduction factor of sunrays and curve devision length
panel_80 = Panel(multiplication_33)

# ==== cluster Cluster
curve = ClusterInput()
curve_2 = Curve(flatten(curve))
point_on_curve = PointOnCurve(curve_2, parameter=0.5)
cull_duplicates = CullDuplicates(Points=point_on_curve, Tolerance=0.1, CullMode=1)  # -> Points, Indices, Valence
list_item = ListItem(List=curve_2, Index=cull_duplicates.Indices, Wrap=True)
i = ClusterOutput(list_item)

# ==== cluster Cluster_2
curve = ClusterInput()
distance = ClusterInput()
offset_curve = OffsetCurve(Curve=curve, Distance=distance, Corners=1)
unit_z = UnitZ(Factor=Slider(100000, range=0..100000))
extrude = Extrude(Base=offset_curve, Direction=unit_z)
multiplication = Multiplication(A=unit_z, B=" -0.5")
move = Move(Geometry=extrude, Motion=multiplication)  # -> Geometry, Transform
cap_holes = CapHoles(Brep=move.Geometry)
plane = ClusterInput()
brep_plane = BrepPlane(Brep=cap_holes, Plane=plane)  # -> Curves, Points
boundary_surfaces = BoundarySurfaces(Edges=brep_plane.Curves)  # -> flatten(Surfaces)
motion = ClusterInput()
move_2 = Move(Geometry=boundary_surfaces, Motion=motion)  # -> Geometry, Transform
shift_list = ShiftList(List=move_2.Geometry, Shift=1, Wrap=True)
split_brep_multiple = SplitBrepMultiple(Brep=move_2.Geometry, Cutters=shift_list)
flatten_tree = FlattenTree(Tree=split_brep_multiple, Path="{0}")
unit_z_2 = UnitZ(Factor=1)
tree = ClusterOutput(flatten_tree)
unit_z_3 = UnitZ(Factor=Slider(0.1, range=0..0.1))
area = Area(Geometry=flatten_tree)  # -> Area, Centroid
settings_speed = SettingsSpeed()
move_3 = Move(Geometry=area.Centroid, Motion=unit_z_3)  # -> Geometry, Transform
mesh_brep = MeshBrep(Brep=flatten_tree, Settings=settings_speed)
mesh_ray = MeshRay(Mesh=mesh_brep, Point=graft(move_3.Geometry), Direction=unit_z_2)  # -> Point, Hit
mass_addition = MassAddition(Input=mesh_ray.Hit)  # -> flatten(Result), PartialResults
boolean = Boolean(mass_addition.Result)
gate_not = GateNot(A=boolean)
result = ClusterOutput(gate_not)

# ==== cluster Cluster_3
objects = ClusterInput()
group = Group(Objects=objects)
bounding_box = BoundingBox(Content=group, Plane=PlaneXY(0, 0, 0))  # -> Box, Box_2
deconstruct_box = DeconstructBox(Box=bounding_box.Box)  # -> Plane, X, Y, Z
deconstruct_domain = DeconstructDomain(Domain=deconstruct_box.Z)  # -> Start, End
A = ClusterInput()
subtraction = Subtraction(A=A, B=deconstruct_domain.Start)
unit_z = UnitZ(Factor=subtraction)
unit_vector = ClusterOutput(unit_z)
